# Dynamo graph AddRevisionSheetByParameter.dyn (Dynamo 2.3.2.15696)
# packages: archi-lab.net 2019.2.25, Genius Loci 2021.7.30

categories = Categories("OST_Sheets")
all_elements_of_category = ElementsOfCategory(Category=categories)

# group: INPUT
parameter_name = StringInput("Sheet Drawing Packages")  # graph input

getParameterValueByName = Element.GetParameterValueByName(element=all_elements_of_category, parameterName=parameter_name)

# group: INPUT
parameter_value = StringInput("CC4b")  # graph input

eq = getParameterValueByName == parameter_value
filterByBoolMask = List.FilterByBoolMask(list=all_elements_of_category, mask=eq)

# group: INPUT
select_revision = RevitRevisions("Seq. 244 - CC4b COORDINATION ISSUE")  # graph input

code_block = CodeBlock { true; }
add_revisions_to_sheet = Custom[Add Revisions to Sheet](Sheet=filterByBoolMask.in, Revision=select_revision, RunIt=code_block)  # package archi-lab.net; This node will add specified revisions to a sheet.
sheetNumber = Sheet.SheetNumber(sheet=filterByBoolMask.in)
code_block_2 = CodeBlock { "83"; }
startsWith = String.StartsWith(str=sheetNumber, searchFor=code_block_2)
filterByBoolMask_2 = List.FilterByBoolMask(list=filterByBoolMask.in, mask=startsWith)

# group: INPUT
parameter_name_2 = StringInput("Appears In Sheet List")  # graph input

getParameterValueByName_2 = Element.GetParameterValueByName(element=all_elements_of_category, parameterName=parameter_name_2)
code_block_3 = CodeBlock { 1; }
eq_2 = getParameterValueByName_2 == code_block_3
filterByBoolMask_3 = List.FilterByBoolMask(list=all_elements_of_category, mask=eq_2)
sheetNumber_2 = Sheet.SheetNumber(sheet=filterByBoolMask.in)
remove_revision_from_sheet = Custom[Remove Revision from Sheet]()  # package archi-lab.net; This node will remove specified Revisions from a sheet.; unwired: Sheet, arg1
select_revision_2 = RevitRevisions()  # nothing selected; graph input
revision_tosheet = Custom[Revision ToSheet](revision=select_revision_2)  # package Genius Loci; Returns the ViewSheets where this Revision participates in the sheet's revision schedule.
contains = String.Contains(str=getParameterValueByName, searchFor=parameter_value)
