# Dynamo graph AddRoomDataToCeilingFloor.dyn (Dynamo 2.3.2.15696)
# packages: Clockwork for Dynamo 2.x 2.3.0, designtech 1.0.8

categories = Categories("OST_Ceilings")
current = Document.Current()
activeView = Document.ActiveView(document=current)
all_elements_of_category_in_view = ElementsOfCategoryInView(Category=categories, View=activeView)
categories_2 = Categories("OST_Floors")
all_elements_of_category_in_view_2 = ElementsOfCategoryInView(Category=categories_2, View=activeView)
categories_3 = Categories("OST_Rooms")
all_elements_of_category = ElementsOfCategory(Category=categories_3)
code_block = CodeBlock { ""; }
code_block_2 = CodeBlock { "Lot_Number"; }
getParameterValueByName = Element.GetParameterValueByName(element=all_elements_of_category, parameterName=code_block_2)
eq = code_block == getParameterValueByName
filterByBoolMask = List.FilterByBoolMask(list=all_elements_of_category, mask=eq)
location = Custom[Element.Location+](element=filterByBoolMask.out)  # package Clockwork for Dynamo 2.x; Returns the location of an element as point, curve or curve loop, along with some booleans to help filtering the results. Unlike the OOTB Element.GetLocation node, it also retunrs sketch lines of sketch-based elements like floor slabs as well as the element's rotation property.
ZAxis = Vector.ZAxis()
code_block_3 = CodeBlock { 1; }
byOriginDirection = Revit.References.RayBounce.ByOriginDirection(origin=location.points, direction=ZAxis, maxBounces=code_block_3, view=activeView)
string_from_object = FromObject(obj=byOriginDirection.elements)
code_block_4 = CodeBlock { "Floor"; }
eq_2 = string_from_object == code_block_4
filterByBoolMask_2 = List.FilterByBoolMask(list=byOriginDirection.elements, mask=eq_2)
code_block_5 = CodeBlock { "Lot Number"; }
code_block_6 = CodeBlock { "Lot_Number"; }
getParameterValueByName_2 = Element.GetParameterValueByName(element=filterByBoolMask.out, parameterName=code_block_6)
setParameterByName = Element.SetParameterByName(parameterName=code_block_5, value=getParameterValueByName_2)  # unwired: element
code_block_7 = CodeBlock { "Ceiling"; }
eq_3 = string_from_object == code_block_7
filterByBoolMask_3 = List.FilterByBoolMask(list=byOriginDirection.elements, mask=eq_3)
isEmpty = List.IsEmpty(list=filterByBoolMask_3.in@L2)
flatten = List.Flatten(list=isEmpty)
filterByBoolMask_4 = List.FilterByBoolMask(list=getParameterValueByName_2, mask=flatten)
byStartPointEndPoint = Line.ByStartPointEndPoint(startPoint=location.points, endPoint=byOriginDirection.points)
flatten_2 = List.Flatten(list=location.points)
flatten_3 = List.Flatten(list=byOriginDirection.points)
point = dtGeometry.Deconstruct.Point(point=flatten_3)
