# Dynamo graph AuditAreaLineByWarning.dyn (Dynamo 2.3.1.11775)
# packages: archi-lab.net 2019.2.25, WombatDynamo 1.3.2, spring nodes 204.1.0, Clockwork for Dynamo 2.x 2.3.0, designtech 1.0.8

watch = Watch()  # unwired: arg0
byId = WombatDynamo.Element.ById(id=watch)
location = Custom[Element.Location+](element=byId)  # package Clockwork for Dynamo 2.x; Returns the location of an element as point, curve or curve loop, along with some booleans to help filtering the results. Unlike the OOTB Element.GetLocation node, it also retunrs sketch lines of sketch-based elements like floor slabs as well as the element's rotation property.
watch_2 = Watch(location.curves)
curve = dtGeometry.Deconstruct.Curve(curve=watch_2)
vector = dtGeometry.Deconstruct.Vector(vector=curve.direction)
abs = Math.Abs(number=vector.x)
abs_2 = Math.Abs(number=vector.y)
gt = abs > abs_2
endPoint = dtGeometry.Deconstruct.Point(point=curve.endPt)  # "Deconstruct.EndPoint"
startPoint = dtGeometry.Deconstruct.Point(point=curve.startPt)  # "Deconstruct.StartPoint"
byCoordinates = Point.ByCoordinates(x=endPoint.x, y=startPoint.y, z=endPoint.z)
byCoordinates_2 = Point.ByCoordinates(x=startPoint.x, y=endPoint.y, z=endPoint.z)
if_ = If(test=gt, true=byCoordinates, false=byCoordinates_2)
byStartPointEndPoint = Line.ByStartPointEndPoint(startPoint=curve.startPt, endPoint=if_)
ꟿ_element_setlocation = Custom[ꟿ Element.SetLocation](element=byId, location=byStartPointEndPoint)  # package spring nodes; Attempts to modify the location of the input element. This can effectively add as a move comand in Revit. Works for both line based and point based elements.
code_block = CodeBlock { "Sheet 1"; }
code_block_2 = CodeBlock { 0; }
transpose = List.Transpose()  # unwired: lists
exportExcel = Data.ExportExcel(sheetName=code_block, startRow=code_block_2, startCol=code_block_2, data=transpose)  # frozen; unwired: filePath
file_path = Filename("C:\Users\bekinci\Documents\revit_audit\AreaLineCoordinates.xlsx")
code_block_3 = CodeBlock { true; }
curve_2 = dtGeometry.Deconstruct.Curve(curve=byStartPointEndPoint)
code_block_4 = CodeBlock { 0; }
getWarnings = archilab.Revit.Elements.Warning.GetWarnings()
errorMessage = archilab.Revit.Elements.Warning.ErrorMessage(warning=getWarnings)
code_block_5 = CodeBlock { "Area separation line is"; }
contains = String.Contains(str=errorMessage, searchFor=code_block_5)
filterByBoolMask = List.FilterByBoolMask(list=getWarnings, mask=contains)
elements = archilab.Revit.Elements.Warning.Elements(warning=filterByBoolMask.in)
flatten = List.Flatten(list=elements)
id = archilab.Revit.Elements.WarningElement.Id(warningElement=flatten)
byId_2 = WombatDynamo.Element.ById(id=id)
count = List.Count(list=byId_2)
lt = _ < count  # unwired: x
code_block_6 = CodeBlock { 1; }
add = _ + code_block_6  # unwired: x
loopWhile = LoopWhile(init=code_block_4, continueWhile=lt, loopBody=add)
element_types = ElementTypes("Group")  # frozen
all_elements_of_type = ElementsOfType(element_type=element_types)
name = Custom[Element.Name+](element=all_elements_of_type)  # package Clockwork for Dynamo 2.x; Gets an element's name. Unlike the OOTB node, this node should work for all Revit elements that have names and will also return the localized names of system parameters, parameter groups, display unit types, parameter types, unit symbol types and unit types.
uniqueItems = List.UniqueItems(list=name)
indexOf = List.IndexOf(list=name, element=uniqueItems)
getItemAtIndex = List.GetItemAtIndex(list=all_elements_of_type, index=indexOf)
members = Custom[Group.Members](group=all_elements_of_type)  # package Clockwork for Dynamo 2.x; Retrieves the members of a group
name_2 = Element.Name(element=members)
code_block_7 = CodeBlock { "Model Lines"; }
contains_2 = String.Contains(str=name_2, searchFor=code_block_7)
filterByBoolMask_2 = List.FilterByBoolMask(list=members, mask=contains_2)
watch_3 = Watch(filterByBoolMask_2.in)
code_block_8 = CodeBlock { false; }
clean = List.Clean(list=watch_3, preserveIndices=code_block_8)
id_2 = Element.Id(element=clean)
flatten_2 = List.Flatten(list=id_2)
setIntersection = List.SetIntersection(list1=flatten_2, list2=watch)
errorMessage_2 = archilab.Revit.Elements.Warning.ErrorMessage(warning=filterByBoolMask.in)
filterByBoolMask_3 = List.FilterByBoolMask(list=all_elements_of_type, mask=contains_2)
watch_4 = Watch(filterByBoolMask_3.in)
