# Dynamo graph AuditFloorBoundaryByWarning.dyn (Dynamo 2.3.1.11775)
# packages: archi-lab.net 2019.2.25, WombatDynamo 1.3.2, Clockwork for Dynamo 2.x 2.3.0, spring nodes 204.1.0, designtech 1.0.8

code_block = CodeBlock { 23696193; }
byId = WombatDynamo.Element.ById(id=code_block)
code_block_2 = CodeBlock { 2457247; }
ꟿ_element_setlocation = Custom[ꟿ Element.SetLocation]()  # package spring nodes; Attempts to modify the location of the input element. This can effectively add as a move comand in Revit. Works for both line based and point based elements.; unwired: element, location
code_block_3 = CodeBlock { 23688337; }
location = Custom[Element.Location+]()  # package Clockwork for Dynamo 2.x; Returns the location of an element as point, curve or curve loop, along with some booleans to help filtering the results. Unlike the OOTB Element.GetLocation node, it also retunrs sketch lines of sketch-based elements like floor slabs as well as the element's rotation property.; unwired: element
watch = Watch(location.curves)
curve = dtGeometry.Deconstruct.Curve(curve=watch)
vector = dtGeometry.Deconstruct.Vector(vector=curve.direction)
abs = Math.Abs(number=vector.x)
abs_2 = Math.Abs(number=vector.y)
div = abs / abs_2
code_block_4 = CodeBlock { 0.35; }
le = div <= code_block_4
code_block_5 = CodeBlock { 0; }
ne = div != code_block_5
and_ = le && ne
if_ = If(test=div, true=and_)  # unwired: false
code_block_6 = CodeBlock { 0; }
allTrue = List.AllTrue()  # unwired: list
code_block_7 = CodeBlock { 0; }
byCoordinates = Vector.ByCoordinates(x=code_block_7, y=vector.y, z=vector.z)
point = dtGeometry.Deconstruct.Point(point=curve.endPt)
sub = point.x - vector.x
location_2 = Custom[Element.Location+]()  # unwired: element
watch_2 = Watch(location_2.mulipleCurves)
curve_2 = dtGeometry.Deconstruct.Curve(curve=watch_2)
watch_3 = Watch(curve_2.startPt)
startPoint = dtGeometry.Deconstruct.Point(point=watch_3)  # "Deconstruct.StartPoint"
endPoint = dtGeometry.Deconstruct.Point(point=curve_2.endPt)  # "Deconstruct.EndPoint"
vector_2 = dtGeometry.Deconstruct.Vector(vector=curve_2.direction)
byStartPointEndPoint = Line.ByStartPointEndPoint(startPoint=curve_2.startPt, endPoint=curve_2.endPt)
getWarnings = archilab.Revit.Elements.Warning.GetWarnings()
errorMessage = archilab.Revit.Elements.Warning.ErrorMessage(warning=getWarnings)
code_block_8 = CodeBlock { "is slightly off axis"; }
contains = String.Contains(str=errorMessage, searchFor=code_block_8)
filterByBoolMask = List.FilterByBoolMask(list=getWarnings, mask=contains)
elements = archilab.Revit.Elements.Warning.Elements(warning=filterByBoolMask.in)
flatten = List.Flatten(list=elements)
id = archilab.Revit.Elements.WarningElement.Id(warningElement=flatten)
byId_2 = WombatDynamo.Element.ById(id=id)
getCategory = Element.GetCategory(element=byId_2)
string_from_object = FromObject(obj=getCategory)
code_block_9 = CodeBlock { "Floors"; }
contains_2 = String.Contains(str=string_from_object, searchFor=code_block_9)
filterByBoolMask_2 = List.FilterByBoolMask(list=byId_2, mask=contains_2)
name = Custom[Element.Name+](element=filterByBoolMask_2.in)  # package Clockwork for Dynamo 2.x; Gets an element's name. Unlike the OOTB node, this node should work for all Revit elements that have names and will also return the localized names of system parameters, parameter groups, display unit types, parameter types, unit symbol types and unit types.
