# Dynamo graph CadLinesByLayer&Color.dyn (Dynamo 2.3.2.15696)
# packages: bimorphNodes 3.0.3, spring nodes 204.1.0

file_path = Filename("C:\Users\bekinci\REVIT_LOCAL\2020\AR_1712011_SIR_CADLINKS_bekinci_bvn.rvt")
reportInstances = CAD.ReportInstances(filePath=file_path)
code_block = CodeBlock { 3; }
dropItems = List.DropItems(list=reportInstances.CADLinks, amount=code_block)
layerNamesInUse = CAD.LayerNamesInUse(importInstance=dropItems@L2)
ꟿ_opening_shaftbycurves = Custom[ꟿ Opening.ShaftByCurves]()  # package spring nodes; Creates a shaft opening. The top level MUST be higher than the base level for a successful execution. You can either provide one base and top level for all shafts or have unique levels for each shaft instance.; unwired: curves, baseLevel, topLevel
code_block_2 = CodeBlock { "M-Peno3"; }
curvesFromCADLayers = CAD.CurvesFromCADLayers(importInstance=dropItems, layerNames=code_block_2)
number_slider = DoubleSlider(0, range=0..15 step 1)
getItemAtIndex = List.GetItemAtIndex(list=curvesFromCADLayers.Curve, index=number_slider)
setObjectStyle = CAD.SetObjectStyle(importInstance=dropItems, layerName=code_block_2)  # unwired: projectionWeight, color
code_block_3 = CodeBlock { "Category"; }
getParameterValueByName = Element.GetParameterValueByName(element=dropItems, parameterName=code_block_3)
name = Element.Name(element=getParameterValueByName)
python_script = Python()  # unwired: IN[0]; starter script, not edited (OUT = 0)
