# Dynamo graph CeilingHeightOffsetByCategory.dyn (Dynamo 2.3.1.11775)

categories = Categories("OST_Ceilings")
all_elements_of_category = ElementsOfCategory(Category=categories)
name = Element.Name(element=all_elements_of_category)
insert_ceiling_family_name = StringInput("INS-101 50mm Thermal Insulation")  # graph input
contains = String.Contains(str=name, searchFor=insert_ceiling_family_name)
filterByBoolMask = List.FilterByBoolMask(list=all_elements_of_category, mask=contains)
code_block = CodeBlock { "Height Offset From Level"; }
change_offset_downwards = BoolSelector(true)  # graph input
getParameterValueByName = Element.GetParameterValueByName(element=filterByBoolMask.in, parameterName=code_block)
offset_value = DoubleInput(100)  # graph input
sub = getParameterValueByName - offset_value
add = getParameterValueByName + offset_value
if_ = If(test=change_offset_downwards, true=sub, false=add)
setParameterByName = Element.SetParameterByName(element=filterByBoolMask.in, parameterName=code_block, value=if_)
