# Dynamo graph ChangeCategoryWorkset.dyn (Dynamo 2.3.1.11775)

categories = Categories("OST_Rooms")
all_elements_of_category = ElementsOfCategory(Category=categories)
code_block = CodeBlock { "Workset"; }
getParameterValueByName = Element.GetParameterValueByName(element=all_elements_of_category, parameterName=code_block)
code_block_2 = CodeBlock { 1873; }
setParameterByName = Element.SetParameterByName(element=all_elements_of_category, parameterName=code_block, value=code_block_2)
