# Dynamo graph ChangeCeilingOffsetFromFloorBySelection.dyn (Dynamo 2.3.2.15696)
# packages: Clockwork for Dynamo 2.x 2.3.0

select_ceiling = DSModelElementSelection()  # 1 picked in the model; graph input
level = Custom[Element.Level](element=select_ceiling)  # package Clockwork for Dynamo 2.x; Gets an element's level
elevation = Level.Elevation(level=level)
select_floor = DSModelElementSelection()  # 1 picked in the model; graph input
level_2 = Custom[Element.Level](element=select_floor)
elevation_2 = Level.Elevation(level=level_2)
sub = elevation - elevation_2
abs = Math.Abs(number=sub)
code_block = CodeBlock { "Height Offset From Level"; }
getParameterValueByName = Element.GetParameterValueByName(element=select_ceiling, parameterName=code_block)
add = getParameterValueByName + elevation
code_block_2 = CodeBlock { "Height Offset From Level"; }
getParameterValueByName_2 = Element.GetParameterValueByName(element=select_floor, parameterName=code_block_2)
add_2 = getParameterValueByName_2 + elevation_2
current_affl = add - add_2
watch = Watch(current_affl)  # graph output
code_block_3 = CodeBlock { "Height Offset From Level"; }
new_affl = DoubleInput(2331)  # graph input
add_3 = new_affl + add_2
sub_2 = add_3 - elevation
setParameterByName = Element.SetParameterByName(element=select_ceiling, parameterName=code_block_3, value=sub_2)
code_block_4 = CodeBlock { 0; }
code_block_5 = CodeBlock { 255; }
code_block_6 = CodeBlock { 0; }
byARGB = Color.ByARGB(r=code_block_4, g=code_block_5, b=code_block_6)
overrideColorInView = Element.OverrideColorInView(element=setParameterByName, color=byARGB)
code_block_7 = CodeBlock { "Ceiling_Height"; }
setParameterByName_2 = Element.SetParameterByName(element=overrideColorInView, parameterName=code_block_7, value=new_affl)
