# Dynamo graph ChangeDimTypebyReferenceObject.dyn (Dynamo 2.3.1.11775)
# packages: designtech 1.0.8

element_types = ElementTypes("DimensionType")
all_elements_of_type = ElementsOfType(element_type=element_types)
name = Element.Name(element=all_elements_of_type)
categories = Categories("OST_Dimensions")
current = Document.Current()
activeView = Document.ActiveView(document=current)
all_elements_of_category_in_view = ElementsOfCategoryInView(Category=categories, View=activeView)
dimensionElements = dtRevit.Element.DimensionElements(dimension=all_elements_of_category_in_view)
string_from_object = FromObject(obj=dimensionElements)
code_block = CodeBlock { "Wall"; }
eq = string_from_object == code_block
filterByBoolMask = List.FilterByBoolMask(list=dimensionElements, mask=eq)
code_block_2 = CodeBlock { "Type"; }
getParameterValueByName = Element.GetParameterValueByName(element=filterByBoolMask.in, parameterName=code_block_2)
string_from_object_2 = FromObject(obj=getParameterValueByName)
code_block_3 = CodeBlock { "P"; }
startsWith = String.StartsWith(str=string_from_object_2, searchFor=code_block_3)
allTrue = List.AllTrue(list=startsWith@L2)
filterByBoolMask_2 = List.FilterByBoolMask(list=all_elements_of_category_in_view, mask=allTrue)
code_block_4 = CodeBlock { "Type"; }
code_block_5 = CodeBlock(IN=all_elements_of_type) { IN[94]; }
setParameterByName = Element.SetParameterByName(element=filterByBoolMask_2.in, parameterName=code_block_4, value=code_block_5)
allFalse = List.AllFalse(list=startsWith@L2)
