# Dynamo graph ChangeDimTypebyViewTemplate.dyn (Dynamo 2.3.2.15696)
# packages: archi-lab.net 2022.210.2419, Clockwork for Dynamo 2.x 2.3.0

categories = Categories("OST_Dimensions")
views = Custom[Document.Views]()  # package Clockwork for Dynamo 2.x; Gets all views in the document - except for 3D view templates (as long as this bug is not fixed: https://github.com/DynamoDS/Dynamo/issues/2970)
code_block = CodeBlock { "View Template"; }
getParameterValueByName = Element.GetParameterValueByName(element=views, parameterName=code_block)
string_from_object = FromObject(obj=getParameterValueByName)

# group: INPUT
code_block_2 = CodeBlock { "32B-1 in 100"; }

contains = String.Contains(str=string_from_object, searchFor=code_block_2)
filterByBoolMask = List.FilterByBoolMask(list=views, mask=contains)
byCategoryAndView = archilab.Revit.Selection.Select.ByCategoryAndView(category=categories, view=filterByBoolMask.in)
name = Custom[Element.Name+](element=byCategoryAndView@L2)  # package Clockwork for Dynamo 2.x; Gets an element's name. Unlike the OOTB node, this node should work for all Revit elements that have names and will also return the localized names of system parameters, parameter groups, display unit types, parameter types, unit symbol types and unit types.

# group: INPUT
code_block_3 = CodeBlock { "1in50_2.0mm Arial_Blue"; }

boolean = BoolSelector(true)
contains_2 = String.Contains(str=name, searchFor=code_block_3, ignoreCase=boolean)
filterByBoolMask_2 = List.FilterByBoolMask(list=byCategoryAndView, mask=contains_2)
flatten = List.Flatten(list=filterByBoolMask_2.in)
code_block_4 = CodeBlock { "Type"; }
element_types = ElementTypes("DimensionType")
all_elements_of_type = ElementsOfType(element_type=element_types)
name_2 = Element.Name(element=all_elements_of_type)

# group: INPUT
code_block_5 = CodeBlock { "1in100_1.5mm Blue"; }

indexOf = String.IndexOf(str=name_2, searchFor=code_block_5)
code_block_6 = CodeBlock { 0; }
allIndicesOf = List.AllIndicesOf(list=indexOf, item=code_block_6)
getItemAtIndex = List.GetItemAtIndex(list=all_elements_of_type, index=allIndicesOf)
setParameterByName = Element.SetParameterByName(element=flatten, parameterName=code_block_4, value=getItemAtIndex, lacing=Longest)
name_3 = Element.Name(element=setParameterByName)
uniqueItems = List.UniqueItems(list=name@L2)
name_4 = Custom[Element.Name+](element=flatten)
