# Dynamo graph ChangeElementWorkset.dyn (Dynamo 2.3.2.15696)
# packages: archi-lab.net 2019.2.25

categories = Categories("OST_Walls")
all_elements_of_category = ElementsOfCategory(Category=categories)
name = Element.Name(element=all_elements_of_category)
code_block = CodeBlock { "CONC"; }
contains = String.Contains(str=name, searchFor=code_block)
filterByBoolMask = List.FilterByBoolMask(list=all_elements_of_category, mask=contains)
code_block_2 = CodeBlock { "Workset"; }
getParameterValueByName = Element.GetParameterValueByName(element=filterByBoolMask.in, parameterName=code_block_2)
worksets = WorksetUi("00_FACADE")
id = archilab.Revit.Elements.Workset.Id(workset=worksets)
eq = getParameterValueByName == id
filterByBoolMask_2 = List.FilterByBoolMask(list=filterByBoolMask.in, mask=eq)
name_2 = Element.Name(element=filterByBoolMask_2.in)
code_block_3 = CodeBlock { "Workset"; }
worksets_2 = WorksetUi("10_STRUCTURE")
id_2 = archilab.Revit.Elements.Workset.Id(workset=worksets_2)
setParameterByName = Element.SetParameterByName(parameterName=code_block_3, value=id_2)  # unwired: element
code_block_4 = CodeBlock { "10_STRUCTURE"; }
