# Dynamo graph ChangeFloorSubPoints.dyn (Dynamo 2.3.2.15696)
# packages: designtech 1.0.8, Clockwork for Dynamo 2.x 2.3.0, spring nodes 204.1.0

select_floor = DSModelElementSelection()  # 1 picked in the model; graph input
points = Floor.Points(floor=select_floor)

# group: DECONSTRUCT AND ROUND AND REMOVE Z COORD FOR LIST.EQUAL TO WORK
point = dtGeometry.Deconstruct.Point(point=points)
round = Math.Round(number=point.x)
round_2 = Math.Round(number=point.y)
byCoordinates = Point.ByCoordinates(x=round, y=round_2)

# group: FLOOR BOUNDARY
ꟿ_collect_elementsketch = Custom[ꟿ Collect.ElementSketch](element=select_floor)  # package spring nodes; Get the actual sketch lines of a sketch based element (floor, ceiling, modified wall, etc.) . You can optionally fetch the matching model curves, however this might prove comptationally heavy on larger data sets. Does not work with elements from linked files.
flatten = List.Flatten(list=ꟿ_collect_elementsketch.curves)
startPoint = Curve.StartPoint(curve=flatten)

# group: DECONSTRUCT AND ROUND FOR LIST.EQUAL TO WORK
point_2 = dtGeometry.Deconstruct.Point(point=startPoint)
round_3 = Math.Round(number=point_2.x)
round_4 = Math.Round(number=point_2.y)
byCoordinates_2 = Point.ByCoordinates(x=round_3, y=round_4)

equals = List.Equals(objectA=byCoordinates, objectB=byCoordinates_2, lacing=Longest)
filterByBoolMask = List.FilterByBoolMask(list=points, mask=equals)

# group: SLAB EDGE HEIGHT
slab_edge_heigth = DoubleInput(1900)  # graph input

# group: SLAB EDGE POINTS
point_3 = dtGeometry.Deconstruct.Point(point=filterByBoolMask.in)
byCoordinates_3 = Point.ByCoordinates(x=point_3.x, y=point_3.y, z=slab_edge_heigth)
slabShapeByPoints = Custom[Floor.SlabShapeByPoints](points=byCoordinates_3, floor=select_floor)  # package Clockwork for Dynamo 2.x; Transform a slab shape based on a list of Points

# group: INTERNAL POINT HEIGHT
internal_point_height = DoubleInput(-50)  # graph input; graph output

# group: INTERNAL POINTS
point_4 = dtGeometry.Deconstruct.Point(point=filterByBoolMask.out)
byCoordinates_4 = Point.ByCoordinates(x=point_4.x, y=point_4.y, z=internal_point_height)
slabShapeByPoints_2 = Custom[Floor.SlabShapeByPoints](points=byCoordinates_4, floor=select_floor)
