# Dynamo graph ChangeRevCloudSequenceBySheet.dyn (Dynamo 2.3.2.15696)

# group: INPUT
select_revision = RevitRevisions("Seq. 400 - FOR INFORMATION")

categories = Categories("OST_RevisionClouds")
categories_2 = Categories("OST_Sheets")
all_elements_of_category = ElementsOfCategory(Category=categories_2)
sheetNumber = Sheet.SheetNumber(sheet=all_elements_of_category)
string = StringInput("12B")
contains = String.Contains(str=sheetNumber, searchFor=string)
filterByBoolMask = List.FilterByBoolMask(list=all_elements_of_category, mask=contains)
all_elements_of_category_in_view = ElementsOfCategoryInView(Category=categories, View=filterByBoolMask.in)
revision = RevisionCloud.Revision(revisionCloud=all_elements_of_category_in_view)
name = Element.Name(element=revision)

# group: EDIT TO FILTER
code_block = CodeBlock { "Seq. 361"; }
contains_2 = String.Contains(str=name, searchFor=code_block)
filterByBoolMask_2 = List.FilterByBoolMask(list=all_elements_of_category_in_view, mask=contains_2)

code_block_2 = CodeBlock { "Revision"; }
setParameterByName = Element.SetParameterByName(element=filterByBoolMask_2.in, parameterName=code_block_2)  # unwired: value
