# Dynamo graph ChangeTagTypebyViewTemplate.dyn (Dynamo 2.3.1.11775)
# packages: archi-lab.net 2022.210.2419, Clockwork for Dynamo 2.x 2.3.0

categories = Categories("OST_WallTags")  # graph input
views = Custom[Document.Views]()  # package Clockwork for Dynamo 2.x; Gets all views in the document - except for 3D view templates (as long as this bug is not fixed: https://github.com/DynamoDS/Dynamo/issues/2970)
code_block = CodeBlock { "View Template"; }
getParameterValueByName = Element.GetParameterValueByName(element=views, parameterName=code_block)
string_from_object = FromObject(obj=getParameterValueByName)
view_template = StringInput("50B-WALLS AND LININGS-50")  # graph input
contains = String.Contains(str=string_from_object, searchFor=view_template)
filterByBoolMask = List.FilterByBoolMask(list=views, mask=contains)  # frozen
byCategoryAndView = archilab.Revit.Selection.Select.ByCategoryAndView(category=categories, view=filterByBoolMask.in)
name = Custom[Element.Name+](element=byCategoryAndView@L2)  # package Clockwork for Dynamo 2.x; Gets an element's name. Unlike the OOTB node, this node should work for all Revit elements that have names and will also return the localized names of system parameters, parameter groups, display unit types, parameter types, unit symbol types and unit types.
view_template_2 = StringInput("50B-WALLS AND LININGS-50")  # graph input
boolean = BoolSelector(true)
contains_2 = String.Contains(str=name, searchFor=view_template_2, ignoreCase=boolean)
filterByBoolMask_2 = List.FilterByBoolMask(list=byCategoryAndView, mask=contains_2)
flatten = List.Flatten(list=filterByBoolMask_2.in)
code_block_2 = CodeBlock { "Type"; }
element_types = ElementTypes("DimensionType")
all_elements_of_type = ElementsOfType(element_type=element_types)
name_2 = Element.Name(element=all_elements_of_type)
view_template_3 = StringInput("50B-WALLS AND LININGS-50")  # graph input
indexOf = String.IndexOf(str=name_2, searchFor=view_template_3)
code_block_3 = CodeBlock { 0; }
allIndicesOf = List.AllIndicesOf(list=indexOf, item=code_block_3)
getItemAtIndex = List.GetItemAtIndex(list=all_elements_of_type, index=allIndicesOf)
setParameterByName = Element.SetParameterByName(element=flatten, parameterName=code_block_2, value=getItemAtIndex, lacing=Longest)
name_3 = Element.Name(element=setParameterByName)
uniqueItems = List.UniqueItems(list=name@L2)
name_4 = Custom[Element.Name+](element=flatten)
categories_2 = Categories("OST_WallTags")  # graph input
all_elements_of_category = ElementsOfCategory(Category=categories_2)
name_5 = Custom[Element.Name+](element=all_elements_of_category@L2)
