# Dynamo graph ChangeViewParameterBySheet.dyn (Dynamo 2.3.2.15696)

code_block = CodeBlock { "Hide at scales coarser than"; }
setParameterByName = Element.SetParameterByName(parameterName=code_block)  # unwired: element, value
categories = Categories("OST_Sheets")
all_elements_of_category = ElementsOfCategory(Category=categories)
sheetNumber = Sheet.SheetNumber(sheet=all_elements_of_category)

# group: FILTER BY SHEET NUMBER BEGINS
sheet_number_pattern = StringInput("30")
startsWith = String.StartsWith(str=sheetNumber, searchFor=sheet_number_pattern)

filterByBoolMask = List.FilterByBoolMask(list=all_elements_of_category, mask=startsWith)
views = Sheet.Views(sheet=filterByBoolMask.in)
string_from_object = FromObject(obj=views)

# group: FILTER OUT LEGENDS
sheet_number_pattern_2 = StringInput("Legend")
startsWith_2 = String.StartsWith(str=string_from_object, searchFor=sheet_number_pattern_2)
filterByBoolMask_2 = List.FilterByBoolMask(list=views, mask=startsWith_2)

flatten = List.Flatten(list=filterByBoolMask_2.out)
getParameterValueByName = Element.GetParameterValueByName(element=flatten, parameterName=code_block)
scale_to_change = CodeBlock { 100; }
