# Dynamo graph ChangeViewTemplateOfView.dyn (Dynamo 2.3.2.15696)
# packages: archi-lab.net 2019.2.25, Clockwork for Dynamo 2.x 2.3.0

categories = Categories("OST_Views")
all_elements_of_category = ElementsOfCategory(Category=categories)
viewTemplate = Custom[View.ViewTemplate](view=all_elements_of_category)  # package Clockwork for Dynamo 2.x; Returns the view template assigned to a given view (if one is assigned)
id = Element.Id(element=viewTemplate)
view_templates = ViewTemplatesUi("12B-1 in 50 GAs")
id_2 = Element.Id(element=view_templates)
eq = id == id_2
filterByBoolMask = List.FilterByBoolMask(list=all_elements_of_category, mask=eq)
code_block = CodeBlock { "View Template"; }
view_templates_2 = ViewTemplatesUi("12B-1 in 50 GAs1")
setParameterByName = Element.SetParameterByName(parameterName=code_block, value=view_templates_2)  # unwired: element
