# Dynamo graph CompareReconciledTags.dyn (Dynamo 2.3.2.15696)
# packages: Ampersand 2019.5.20, Genius Loci 2021.7.30, Synthesize toolkit 4.6.4

# group: SELECT CATEGORY
categories = Categories("OST_MultiCategoryTags")
python_script = Python(IN[0]=categories)
# ---------- python_script.python (35 lines) ----------
import clr

clr.AddReference("RevitServices")
from RevitServices.Persistence import DocumentManager
doc = DocumentManager.Instance.CurrentDBDocument

clr.AddReference("RevitAPI")
from Autodesk.Revit.DB import FilteredElementCollector

clr.AddReference("RevitNodes")
import Revit
clr.ImportExtensions(Revit.Elements)

def tolist(obj1):
	if hasattr(obj1,"__iter__"): return obj1
	else: return [obj1]

cat = UnwrapElement(IN[0])
OUT = []

ueWrapper = None
wrappers = clr.GetClrType(Revit.Elements.ElementWrapper).GetMethods()
for w in wrappers:
	if w.ToString().startswith("Revit.Elements.UnknownElement"):
		ueWrapper = w
		break

if ueWrapper is not None:
	fec = FilteredElementCollector(doc).WhereElementIsNotElementType()
	if cat is not None:
		fec = fec.OfCategoryId(cat.Id)
	view_el = []
	for e in fec:
		view_el.append(ueWrapper.Invoke(None, (e, True) ) )
	OUT.append(view_el)
# ----------------------------------------
flatten = List.Flatten(list=python_script)
id = Element.Id(element=flatten)

file_path = Filename("C:\Users\bekinci\Documents\revit error\20230125_POD WINDOWS TAGS\TagCompare.xlsx")
file_from_path = FileObject(path=file_path)
code_block = CodeBlock { "Sheet1"; }
code_block_2 = CodeBlock { false; }
importExcel = Data.ImportExcel(file=file_from_path, sheetName=code_block, readAsStrings=code_block_2, showExcel=code_block_2)
code_block_3 = CodeBlock { 1; }
dropItems = List.DropItems(list=importExcel, amount=code_block_3)
flatten_2 = List.Flatten(list=dropItems)
code_block_4 = CodeBlock(x=flatten_2) { x:int[]; }
setIntersection = List.SetIntersection(list1=code_block_4, list2=id)
contains = List.Contains(list=setIntersection@L2, item=id@L1, lacing=Longest)
filterByBoolMask = List.FilterByBoolMask(list=flatten, mask=contains)
flatten_3 = List.Flatten(list=filterByBoolMask.in)
sortIndexByValue = List.SortIndexByValue(list=setIntersection)
sortByKey = List.SortByKey(list=flatten_3, keys=sortIndexByValue)

# group: COMPARE FAMILY
list_splitoddeven = Custom[[&] List.SplitOddEven](list=sortByKey.sorted_list)  # package Ampersand
name = Element.Name(element=list_splitoddeven.odds)
name_2 = Element.Name(element=list_splitoddeven.evens)
eq = name == name_2
allTrue = List.AllTrue(list=eq)

# group: COMPARE HOST
al_get_documents = Custom[AL.Get Documents]()  # package Synthesize toolkit; Queries all linked Revit files and retrieves their Name, LinkInstance and Document properties.
code_block_5 = CodeBlock(x=al_get_documents.Link_Doc) { x[3]; }
tag_taggedelement = Custom[Tag TaggedElement](tag=list_splitoddeven.evens, docOrRevitLinkInstance=code_block_5)  # package Genius Loci; Get tagged element. Unlike the OOTB node it works also for linked element, linked room, room, space and area categories.
id_2 = Element.Id(element=tag_taggedelement)
file_path_2 = Filename("C:\Users\bekinci\Documents\revit error\20230125_POD WINDOWS TAGS\SIR_Missing Pod Window Tags.csv")
importCSV = Data.ImportCSV(filePath=file_path_2)
lastItem = List.LastItem(list=importCSV)
code_block_6 = CodeBlock { 567; }
dropEveryNthItem = List.DropEveryNthItem(list=lastItem, n=code_block_6)
code_block_7 = CodeBlock { 568; }
dropEveryNthItem_2 = List.DropEveryNthItem(list=dropEveryNthItem, n=code_block_7)
eq_2 = id_2 == dropEveryNthItem_2
allTrue_2 = List.AllTrue(list=eq_2)

# group: COMPARE LOCATION
python_script_2 = Python(IN[0]=list_splitoddeven.odds)
# ---------- python_script_2.python (30 lines) ----------
import clr
clr.AddReference('RevitAPI')
from Autodesk.Revit.DB import*

clr.AddReference('RevitServices')
from RevitServices.Persistence import DocumentManager
from RevitServices.Transactions import TransactionManager

clr.AddReference('RevitNodes')
import Revit
clr.ImportExtensions(Revit.GeometryConversion)
clr.ImportExtensions(Revit.Elements)


doc = DocumentManager.Instance.CurrentDBDocument

tags = []
xyz = []

if isinstance(IN[0],list):
	for i in IN[0]:
		tags.append(UnwrapElement(i))
	for t in tags:
		xyz.append(t.TagHeadPosition.ToPoint())
else:
	tags = UnwrapElement(IN[0])
	xyz = tags.TagHeadPosition.ToPoint()


OUT = xyz
# ----------------------------------------
python_script_3 = Python(IN[0]=list_splitoddeven.evens)  # same code as python_script_2
equals = List.Equals(objectA=python_script_2, objectB=python_script_3)
allTrue_3 = List.AllTrue(list=equals)
