# Dynamo graph CopyDetailsFromFloorplanToAreaplan.dyn (Dynamo 2.3.2.15696)
# packages: Orchid 206.3.0.7792, Genius Loci 2021.7.30, Modelical 2.2.14, spring nodes 202.1.1, Rhythm 2020.9.8

view_type = ViewType("THERMAL INSULATION")
all_elements_of_type = Custom[All Elements of Type+](type=view_type)  # package Genius Loci; Get the instances of the given type. Works with ElementType, FamilyType, ViewFamilyType, Wall/Floor/Roof/CeilingType, GroupType, FilledRegionType and TextNoteType.
code_block = CodeBlock { "Associated Level"; }
getParameterValueByName = Element.GetParameterValueByName(element=all_elements_of_type, parameterName=code_block)
categories = Categories("OST_Sheets")
all_elements_of_category = ElementsOfCategory(Category=categories)
sheetNumber = Sheet.SheetNumber(sheet=all_elements_of_category)
code_block_2 = CodeBlock { "10B"; }
startsWith = String.StartsWith(str=sheetNumber, searchFor=code_block_2)
filterByBoolMask = List.FilterByBoolMask(list=all_elements_of_category, mask=startsWith)
views = Sheet.Views(sheet=filterByBoolMask.in)
string_from_object = FromObject(obj=views)
code_block_3 = CodeBlock { "FloorPlanView"; }
startsWith_2 = String.StartsWith(str=string_from_object, searchFor=code_block_3)
filterByBoolMask_2 = List.FilterByBoolMask(list=views, mask=startsWith_2)
code_block_4 = CodeBlock { "Associated Level"; }
getParameterValueByName_2 = Element.GetParameterValueByName(element=filterByBoolMask_2.in, parameterName=code_block_4)
flatten = List.Flatten(list=getParameterValueByName_2)

# group: DELETE EXCESSIVE VIEWS
setDifference = List.SetDifference(list1=flatten, list2=getParameterValueByName)  # frozen
indexOf = List.IndexOf(list=getParameterValueByName, element=setDifference)
getItemAtIndex = List.GetItemAtIndex(list=all_elements_of_type, index=indexOf)
delete = Element.Delete(element=getItemAtIndex)  # frozen

flatten_2 = List.Flatten(list=filterByBoolMask_2.in)
indexOf_2 = List.IndexOf(list=flatten, element=getParameterValueByName)
sortByKey = List.SortByKey(list=all_elements_of_type, keys=indexOf_2)
copyViewRange = Custom[CopyViewRange](sourceView=flatten_2, targetView=sortByKey.sorted_list)  # frozen; package Modelical; Copy the view range of a view(s) to other(s).
categories_2 = Categories("OST_PlanRegion")  # frozen
all_elements_of_category_in_view = ElementsOfCategoryInView(Category=categories_2, View=flatten_2)
ꟿ_document_copyfromviewtoview = Custom[ꟿ Document.CopyFromViewToView](sourceView=flatten_2, destView=sortByKey.sorted_list, elements=all_elements_of_category_in_view)  # package spring nodes; The node will copy the input (view based) elements from the source view into the destination view.
ʳʰʸᵗʰᵐ_view_getcropregionelement = Rhythm.Revit.Views.View.GetCropRegionElement(view=flatten_2)
ꟿ_document_copyfromviewtoview_2 = Custom[ꟿ Document.CopyFromViewToView](sourceView=flatten_2, destView=sortByKey.sorted_list, elements=ʳʰʸᵗʰᵐ_view_getcropregionelement)
