# Dynamo graph CopyRoomTagFromViewTemplateToViewTemplate.dyn (Dynamo 2.3.1.11775)
# packages: Clockwork for Dynamo 2.x 2.3.0, archi-lab.net 2019.2.25, spring nodes 204.1.0

# group: INPUT
code_block = CodeBlock { "53B-RCP-50"; }

# group: INPUT
code_block_2 = CodeBlock { "65B-1 in 50 FLOOR FINISHES"; }

categories = Categories("OST_RoomTags")
all_elements_of_category_in_view = ElementsOfCategoryInView(Category=categories)  # unwired: View
delete = Element.Delete(element=all_elements_of_category_in_view)  # frozen
categories_2 = Categories("OST_RoomTags")  # frozen
all_elements_of_category_in_view_2 = ElementsOfCategoryInView(Category=categories_2)  # unwired: View
code_block_3 = CodeBlock { "Family"; }
getParameterValueByName = Element.GetParameterValueByName(element=all_elements_of_category_in_view_2, parameterName=code_block_3)
name = Element.Name(element=getParameterValueByName)
code_block_4 = CodeBlock { "room name"; }
contains = String.Contains(str=name, searchFor=code_block_4)
filterByBoolMask = List.FilterByBoolMask(list=all_elements_of_category_in_view_2, mask=contains)
getLocation = Element.GetLocation(element=filterByBoolMask.in)
X = Point.X(point=getLocation)
code_block_5 = CodeBlock { true; }
code_block_6 = CodeBlock { false; }
byElementAndLocation = Tag.ByElementAndLocation(location=X, horizontal=code_block_5, addLeader=code_block_6)  # unwired: view, element
source_view_template = StringInput("12B-1 in 50 GAs")  # graph input
code_block_7 = CodeBlock { "-"; }
split = String.Split(str=source_view_template, separator0=code_block_7)
firstItem = List.FirstItem(list=split)

# group: Source Views
categories_3 = Categories("OST_Sheets")
all_elements_of_category = ElementsOfCategory(Category=categories_3)
sheetNumber = Sheet.SheetNumber(sheet=all_elements_of_category)
contains_2 = String.Contains(str=sheetNumber, searchFor=firstItem)
filterByBoolMask_2 = List.FilterByBoolMask(list=all_elements_of_category, mask=contains_2)
views = Sheet.Views(sheet=filterByBoolMask_2.in)
code_block_8 = CodeBlock { "View Template"; }
getParameterValueByName_2 = Element.GetParameterValueByName(element=views, parameterName=code_block_8)
string_from_object = FromObject(obj=getParameterValueByName_2)
contains_3 = String.Contains(str=string_from_object, searchFor=source_view_template)
filterByBoolMask_3 = List.FilterByBoolMask(list=views, mask=contains_3)
type = Custom[View.Type](view=filterByBoolMask_3.in@L2)  # package Clockwork for Dynamo 2.x; Returns the type of a given view
string_from_object_2 = FromObject(obj=type)
code_block_9 = CodeBlock { "FloorPlan"; }
contains_4 = String.Contains(str=string_from_object_2, searchFor=code_block_9)
filterByBoolMask_4 = List.FilterByBoolMask(list=filterByBoolMask_3.in, mask=contains_4)
code_block_10 = CodeBlock { "12B"; }

code_block_11 = CodeBlock { false; }
clean = List.Clean(list=filterByBoolMask_4.in, preserveIndices=code_block_11)
flatten = List.Flatten(list=clean)
name_2 = Element.Name()  # unwired: element
sortByFunction = List.SortByFunction(list=flatten, func=name_2)
target_view_template = StringInput("65B-1 in 50 FLOOR FINISHES")  # graph input
code_block_12 = CodeBlock { "-"; }
split_2 = String.Split(str=target_view_template, separator0=code_block_12)
firstItem_2 = List.FirstItem(list=split_2)

# group: Target Views
categories_4 = Categories("OST_Sheets")
all_elements_of_category_2 = ElementsOfCategory(Category=categories_4)
sheetNumber_2 = Sheet.SheetNumber(sheet=all_elements_of_category_2)
contains_5 = String.Contains(str=sheetNumber_2, searchFor=firstItem_2)
filterByBoolMask_5 = List.FilterByBoolMask(list=all_elements_of_category_2, mask=contains_5)
views_2 = Sheet.Views(sheet=filterByBoolMask_5.in)
code_block_13 = CodeBlock { "View Template"; }
getParameterValueByName_3 = Element.GetParameterValueByName(element=views_2, parameterName=code_block_13)
string_from_object_3 = FromObject(obj=getParameterValueByName_3)
contains_6 = String.Contains(str=string_from_object_3, searchFor=target_view_template)
filterByBoolMask_6 = List.FilterByBoolMask(list=views_2, mask=contains_6)
type_2 = Custom[View.Type](view=filterByBoolMask_6.in@L2)
string_from_object_4 = FromObject(obj=type_2)
code_block_14 = CodeBlock { "FloorPlan"; }
contains_7 = String.Contains(str=string_from_object_4, searchFor=code_block_14)
filterByBoolMask_7 = List.FilterByBoolMask(list=filterByBoolMask_6.in, mask=contains_7)

code_block_15 = CodeBlock { false; }
clean_2 = List.Clean(list=filterByBoolMask_7.in, preserveIndices=code_block_15)
flatten_2 = List.Flatten(list=clean_2)
name_3 = Element.Name()  # unwired: element
sortByFunction_2 = List.SortByFunction(list=flatten_2, func=name_3)
categories_5 = Categories("OST_RoomTags")
all_elements_of_category_in_view_3 = ElementsOfCategoryInView(Category=categories_5, View=sortByFunction)
ꟿ_document_copyfromviewtoview = Custom[ꟿ Document.CopyFromViewToView](sourceView=sortByFunction, destView=sortByFunction_2, elements=all_elements_of_category_in_view_3)  # package spring nodes; The node will copy the input (view based) elements from the source view into the destination view.
name_4 = Custom[Element.Name+]()  # package Clockwork for Dynamo 2.x; Gets an element's name. Unlike the OOTB node, this node should work for all Revit elements that have names and will also return the localized names of system parameters, parameter groups, display unit types, parameter types, unit symbol types and unit types.; unwired: element
code_block_16 = CodeBlock { "30B-B01-101_1 LEVEL 01-02_LOT 6 - UPPER"; }
contains_8 = String.Contains(str=name_4, searchFor=code_block_16)
filterByBoolMask_8 = List.FilterByBoolMask(mask=contains_8)  # unwired: list
views_3 = Custom[Document.Views]()  # frozen; package Clockwork for Dynamo 2.x; Gets all views in the document - except for 3D view templates (as long as this bug is not fixed: https://github.com/DynamoDS/Dynamo/issues/2970)
code_block_17 = CodeBlock { "View Template"; }
getParameterValueByName_4 = Element.GetParameterValueByName(element=views_3, parameterName=code_block_17)
string_from_object_5 = FromObject(obj=getParameterValueByName_4)

# group: INPUT
code_block_18 = CodeBlock { "12B-1 in 50 GAs"; }

contains_9 = String.Contains(str=string_from_object_5, searchFor=code_block_18)
filterByBoolMask_9 = List.FilterByBoolMask(list=views_3, mask=contains_9)
isOnSheet = archilab.Revit.Views.Views.IsOnSheet(view=filterByBoolMask_9.in)
filterByBoolMask_10 = List.FilterByBoolMask(list=filterByBoolMask_9.in, mask=isOnSheet)
name_5 = Element.Name(element=filterByBoolMask_10.in)
sort = List.Sort(list=name_5)
indexOf = List.IndexOf(list=name_5, element=sort)
sortIndexByValue = List.SortIndexByValue(list=indexOf)
sortByKey = List.SortByKey(list=filterByBoolMask_10.in, keys=sortIndexByValue)
dropLastItem = Custom[List.DropLastItem](list=sortByKey.sorted_list)  # package Clockwork for Dynamo 2.x; Drops the last item from a given list.
firstItem_3 = List.FirstItem(list=dropLastItem)
views_4 = Custom[Document.Views]()  # frozen
code_block_19 = CodeBlock { "View Template"; }
getParameterValueByName_5 = Element.GetParameterValueByName(element=views_4, parameterName=code_block_19)
string_from_object_6 = FromObject(obj=getParameterValueByName_5)

# group: INPUT
code_block_20 = CodeBlock { "50B-WALLS AND LININGS-50"; }

contains_10 = String.Contains(str=string_from_object_6, searchFor=code_block_20)
filterByBoolMask_11 = List.FilterByBoolMask(list=views_4, mask=contains_10)
isOnSheet_2 = archilab.Revit.Views.Views.IsOnSheet(view=filterByBoolMask_11.in)
filterByBoolMask_12 = List.FilterByBoolMask(list=filterByBoolMask_11.in, mask=isOnSheet_2)
name_6 = Element.Name(element=filterByBoolMask_12.in)
sort_2 = List.Sort(list=name_6)
indexOf_2 = List.IndexOf(list=name_6, element=sort_2)
sortIndexByValue_2 = List.SortIndexByValue(list=indexOf_2)
sortByKey_2 = List.SortByKey(list=filterByBoolMask_12.in, keys=sortIndexByValue_2)
flatten_3 = List.Flatten(list=sortByKey_2.sorted_list)
firstItem_4 = List.FirstItem(list=flatten_3)
categories_6 = Categories("OST_GenericAnnotation")
all_elements_of_category_in_view_4 = ElementsOfCategoryInView(Category=categories_6, View=firstItem_3)
ꟿ_document_copyfromviewtoview_2 = Custom[ꟿ Document.CopyFromViewToView](sourceView=firstItem_3, destView=firstItem_4, elements=all_elements_of_category_in_view_4)
flatten_4 = List.Flatten(list=dropLastItem)
count = List.Count(list=all_elements_of_category_in_view_4@L2)
dropLastItem_2 = Custom[List.DropLastItem](list=sortByFunction)
string = StringInput("65B-1 in 50 FLOOR FINISHES")
string_2 = StringInput("50B-WALLS AND LININGS-50")
