# Dynamo graph CropElevationByWall.dyn (Dynamo 2.3.1.11775)
# packages: Rhythm 2019.9.12, designtech 1.0.8, archi-lab.net 2019.2.25, Clockwork for Dynamo 2.x 2.3.0, WombatDynamo 1.3.2, EvolveLAB-Beaker 2.0.1

categories = Categories("OST_Walls")
elementsInViewByCategory = dtRevit.Collector.ElementsInViewByCategory(category=categories)  # unwired: views
indexOf = List.IndexOf(list=elementsInViewByCategory)  # unwired: element
removeItemAtIndex = List.RemoveItemAtIndex(list=elementsInViewByCategory, indices=indexOf)
code_block = CodeBlock { true; }
byProperties = Revit.Filter.OverrideGraphicSettings.ByProperties(halftone=code_block)
overrideInView = Element.OverrideInView(element=removeItemAtIndex, overrides=byProperties)
categories_2 = Categories("OST_Sheets")
byCategory = Revit.Collector.ByCategory(category=categories_2)
sheetNumber = Sheet.SheetNumber(sheet=byCategory.elements)
sheet_number = StringInput("32D-LXX- 111")  # graph input
eq = sheetNumber == sheet_number
filterByBoolMask = List.FilterByBoolMask(list=byCategory.elements, mask=eq)
view_type = ViewTypesUi("Elevation")
getByType = archilab.Revit.Views.Views.GetByType(viewType=view_type)
name = Element.Name(element=getByType)
select_elevation = DSModelElementSelection()  # 1 picked in the model; graph input
name_2 = Element.Name(element=select_elevation)
eq_2 = name == name_2
filterByBoolMask_2 = List.FilterByBoolMask(list=getByType, mask=eq_2)
view_templates = ViewTemplatesUi("32D_1 in 50")  # graph input
setViewTemplate = archilab.Revit.Views.Views.SetViewTemplate(view=filterByBoolMask_2.in, viewTemplate=view_templates)
code_block_2 = CodeBlock { 0; }
byCoordinates = Point.ByCoordinates(x=code_block_2, y=code_block_2, z=code_block_2)
ʳʰʸᵗʰᵐ_viewport_create = Rhythm.Revit.Elements.Viewport.Create(sheet=filterByBoolMask.in, view=setViewTemplate, location=byCoordinates, lacing=Longest)
select_wall = DSModelElementSelection()  # 1 picked in the model; graph input
boundingBox = Element.BoundingBox(element=select_wall)
passthrough = Custom[Passthrough](passThrough=boundingBox, waitFor=setViewTemplate)  # package Clockwork for Dynamo 2.x; Forces a sequential order of execution. The node wired into the output of the Passthrough node will be executed *after* the node wired into the waitFor input (e.g. important for some Revit operations). The value of the passThrough input will be passed on to the node wired into the output port of the Passthrough node.
setCropRegion = Rhythm.Revit.Views.View.SetCropRegion(view=setViewTemplate, bBox=passthrough)
passthrough_2 = Custom[Passthrough](passThrough=select_wall, waitFor=setCropRegion.success)
getLocation = Element.GetLocation()  # unwired: element
startPoint = Curve.StartPoint(curve=getLocation)
point = dtGeometry.Deconstruct.Point(point=startPoint)
boundingBox_2 = Element.BoundingBox()  # unwired: element
minPoint = BoundingBox.MinPoint(boundingBox=boundingBox_2)
point_2 = dtGeometry.Deconstruct.Point(point=minPoint)
code_block_3 = CodeBlock { 300; }
sub = point_2.z - code_block_3
byCoordinates_2 = Point.ByCoordinates(x=point.x, y=point.y, z=sub)
endPoint = Curve.EndPoint(curve=getLocation)
point_3 = dtGeometry.Deconstruct.Point(point=endPoint)
byCoordinates_3 = Point.ByCoordinates(x=point_3.x, y=point_3.y, z=sub)
byStartPointEndPoint = Line.ByStartPointEndPoint(startPoint=byCoordinates_2, endPoint=byCoordinates_3)
dimensions = WombatDynamo.BoundingBox.Dimensions(bbox=boundingBox_2)
code_block_4 = CodeBlock { 600; }
add = dimensions.Z + code_block_4
