# Dynamo graph DeleteSheetsByTitleBlock.dyn (Dynamo 2.3.2.15696)
# packages: spring nodes 204.1.0, Synthesize toolkit 4.6.4, Data-Shapes 2021.2.94

categories = Categories("OST_Sheets")
all_elements_of_category = ElementsOfCategory(Category=categories)
code_block = CodeBlock { "Sheet Number"; }
getParameterValueByName = Element.GetParameterValueByName(element=all_elements_of_category, parameterName=code_block)
sheet_Titleblock = Custom[Sheet_Titleblock](Sheet=all_elements_of_category)  # package Data-Shapes; Gets the titleblock used in a Sheet

# group: TITLEBLOCK PARAMETER
titleblock_parameter = StringInput("NOT_IN_USE")  # graph input

getParameterValueByName_2 = Element.GetParameterValueByName(element=sheet_Titleblock.TitleBlock_FamilyInstance, parameterName=titleblock_parameter)
parameter_value = StringInput("1")  # graph input
eq = getParameterValueByName_2 == parameter_value
filterByBoolMask = List.FilterByBoolMask(list=sheet_Titleblock.TitleBlock_FamilyInstance, mask=eq)
string = StringInput("Sheet Number")
getParameterValueByName_3 = Element.GetParameterValueByName(element=filterByBoolMask.in, parameterName=string)
indexOf = List.IndexOf(list=getParameterValueByName, element=getParameterValueByName_3)
getItemAtIndex = List.GetItemAtIndex(list=all_elements_of_category, index=indexOf)

# group: EXCLUDE LEGENDS
ꟿ_sheet_views = Custom[ꟿ Sheet.Views+](sheet=getItemAtIndex)  # package spring nodes; Extracts all views and schedules (minus the revision schedule) placed on the input sheet (or sheets). Will be depreciated once the bult in node works with all plan types.
flatten = List.Flatten(list=ꟿ_sheet_views.view_s)
string_from_object = FromObject(obj=flatten)
code_block_2 = CodeBlock { "Legend"; }
startsWith = String.StartsWith(str=string_from_object, searchFor=code_block_2)
filterByBoolMask_2 = List.FilterByBoolMask(list=flatten, mask=startsWith)

delete = Element.Delete(element=filterByBoolMask_2.out)
passthrough = Custom[CW.Passthrough](passThrough=getItemAtIndex, waitFor=delete)  # package Synthesize toolkit; Forces a sequential order of execution. The node wired into the output of the Passthrough node will be executed *after* the node wired into the waitFor input (e.g. important for some Revit operations). The value of the passThrough input will be passed on to the node wired into the output port of the Passthrough node.
delete_2 = Element.Delete(element=passthrough)
