# Dynamo graph DeleteSheetsWithViews.dyn (Dynamo 2.3.2.15696)
# packages: spring nodes 204.1.0, Synthesize toolkit 4.6.4, archi-lab.net 2019.2.25, Clockwork for Dynamo 2.x 2.3.0

categories = Categories("OST_Sheets")
all_elements_of_category = ElementsOfCategory(Category=categories)

# group: BY REVISION
revisions = archilab.Revit.Views.Sheets.Revisions(sheet=all_elements_of_category)
select_revision = RevitRevisions("Seq. 613 (Issued) - NO LONGER IN USE")
contains = List.Contains(list=revisions@L2, item=select_revision)

filterByBoolMask = List.FilterByBoolMask(list=all_elements_of_category, mask=contains)

# group: EXCLUDE LEGENDS
ꟿ_sheet_views = Custom[ꟿ Sheet.Views+](sheet=filterByBoolMask.in)  # package spring nodes; Extracts all views and schedules (minus the revision schedule) placed on the input sheet (or sheets). Will be depreciated once the bult in node works with all plan types.
flatten = List.Flatten(list=ꟿ_sheet_views.view_s)
string_from_object = FromObject(obj=flatten)
code_block = CodeBlock { "Legend"; }
startsWith = String.StartsWith(str=string_from_object, searchFor=code_block)
filterByBoolMask_2 = List.FilterByBoolMask(list=flatten, mask=startsWith)

delete = Element.Delete(element=filterByBoolMask_2.out)
passthrough = Custom[CW.Passthrough](passThrough=filterByBoolMask.in, waitFor=delete)  # package Synthesize toolkit; Forces a sequential order of execution. The node wired into the output of the Passthrough node will be executed *after* the node wired into the waitFor input (e.g. important for some Revit operations). The value of the passThrough input will be passed on to the node wired into the output port of the Passthrough node.
delete_2 = Element.Delete(element=passthrough)

# group: BY PARAMETER
code_block_2 = CodeBlock { "Design Stage"; }
getParameterValueByName = Element.GetParameterValueByName(element=all_elements_of_category, parameterName=code_block_2)
string = StringInput("")
eq = getParameterValueByName == string
startsWith_2 = String.StartsWith(str=getParameterValueByName, searchFor=string)
string_2 = StringInput("Sheet Number")

sheetNumber = Sheet.SheetNumber(sheet=filterByBoolMask.in)
dependentViews = Custom[View.DependentViews](view=filterByBoolMask_2.out)  # package Clockwork for Dynamo 2.x; Returns all dependent views of a given view
convertToIndependent = Custom[View.ConvertToIndependent](view=dependentViews)  # package Clockwork for Dynamo 2.x; Converts a given dependent view to an independent view
if_ = If(test=dependentViews)  # unwired: true, false
