# Dynamo graph GetAnnotationFromViews.dyn (Dynamo 2.3.2.15696)
# packages: spring nodes 204.1.0

categories = Categories("OST_RoomTags")
categories_2 = Categories("OST_Sheets")
all_elements_of_category = ElementsOfCategory(Category=categories_2)
sheetNumber = Sheet.SheetNumber(sheet=all_elements_of_category)
code_block = CodeBlock { "11B"; }
code_block_2 = CodeBlock { true; }
startsWith = String.StartsWith(str=sheetNumber, searchFor=code_block, ignoreCase=code_block_2)
filterByBoolMask = List.FilterByBoolMask(list=all_elements_of_category, mask=startsWith)
views = Sheet.Views(sheet=filterByBoolMask.in)
name = Element.Name(element=views)
code_block_3 = CodeBlock { true; }
startsWith_2 = String.StartsWith(str=name, searchFor=code_block, ignoreCase=code_block_3)
filterByBoolMask_2 = List.FilterByBoolMask(list=views, mask=startsWith_2)
flatten = List.Flatten(list=filterByBoolMask_2.in)
all_elements_of_category_in_view = ElementsOfCategoryInView(Category=categories, View=flatten)
flatten_2 = List.Flatten(list=all_elements_of_category_in_view)
ꟿ_selectinrevit = Custom[ꟿ SelectInRevit](element=flatten_2)  # package spring nodes; Selects the input elements inside the Revit UI.
