# Dynamo graph GetCeilingOffsetFromFloor.dyn (Dynamo 2.3.2.15696)
# packages: spring nodes 204.1.0, Clockwork for Dynamo 2.x 2.3.0

categories = Categories("OST_Ceilings")
views = Views("CEILING AFFL")
all_elements_of_category_in_view = ElementsOfCategoryInView(Category=categories, View=views)
ꟿ_collect_elementsketch = Custom[ꟿ Collect.ElementSketch](element=all_elements_of_category_in_view)  # package spring nodes; Get the actual sketch lines of a sketch based element (floor, ceiling, modified wall, etc.) . You can optionally fetch the matching model curves, however this might prove comptationally heavy on larger data sets. Does not work with elements from linked files.
watch = Watch(ꟿ_collect_elementsketch.curves)
geometry = Element.Geometry()  # unwired: element
flatten = List.Flatten(list=geometry)
string_from_object = FromObject(obj=flatten)
code_block = CodeBlock { "Solid"; }
eq = string_from_object == code_block
filterByBoolMask = List.FilterByBoolMask(list=geometry, mask=eq)
faces = Topology.Faces(topology=filterByBoolMask.in)
origin = Plane.Origin()  # unwired: plane
code_block_2 = CodeBlock { 1; }
flatten_2 = List.Flatten(list=ꟿ_collect_elementsketch.curves, amt=code_block_2)
byJoinedCurves = PolyCurve.ByJoinedCurves(curves=flatten_2)
ꟿ_polycurve_points = Custom[ꟿ PolyCurve.Points](polyCurve=byJoinedCurves)  # package spring nodes; Gets all the unique start and end points of the underlying curves in a sorted list.
byPoints = Polygon.ByPoints(points=ꟿ_polycurve_points)
center = Polygon.Center(polygon=byPoints)
ZAxisNegative = Custom[Vector.ZAxisNegative]()  # package Clockwork for Dynamo 2.x; Returns an XYZ of 0,0,-1
code_block_3 = CodeBlock { 1; }
byOriginDirection = Revit.References.RayBounce.ByOriginDirection(origin=center, direction=ZAxisNegative, maxBounces=code_block_3, view=views)
firstItem = List.FirstItem(list=byOriginDirection.points@L2)
flatten_3 = List.Flatten(list=byOriginDirection.elements)
clean = List.Clean(list=flatten_3)
string_from_object_2 = FromObject(obj=clean)
code_block_4 = CodeBlock { "Floor"; }
eq_2 = string_from_object_2 == code_block_4
filterByBoolMask_2 = List.FilterByBoolMask(list=flatten_3, mask=eq_2)
list_create = List.Create(item0=all_elements_of_category_in_view, item1=filterByBoolMask_2.in)
byElements = Dimension.ByElements(view=views, referenceElements=list_create)
flatten_4 = List.Flatten(list=filterByBoolMask_2.in)
