# Dynamo graph GetDimReference.dyn (Dynamo 2.3.1.11775)
# packages: BVN 1.6.1, designtech 1.0.8

categories = Categories("OST_Dimensions")
code_block = CodeBlock { true; }
getAll = Custom[View.GetAll](toggle=code_block)  # package BVN; Gets all views except for view templates
name = Element.Name(element=getAll)
code_block_2 = CodeBlock { "50B"; }
contains = String.Contains(str=name, searchFor=code_block_2)
filterByBoolMask = List.FilterByBoolMask(list=getAll, mask=contains)
all_elements_of_category_in_view = ElementsOfCategoryInView(Category=categories, View=filterByBoolMask.in)
dimensionElements = dtRevit.Element.DimensionElements(dimension=all_elements_of_category_in_view)
getCategory = Element.GetCategory(element=dimensionElements)
flatten = List.Flatten(list=getCategory@L4)
uniqueItems = List.UniqueItems(list=flatten@L2)
fromObject = dtCore.String.FromObject(obj=getCategory)
code_block_3 = CodeBlock { "Casework"; }
code_block_4 = CodeBlock { "Plumbing Fixtures"; }
code_block_5 = CodeBlock { "Curtain Wall Mullions"; }
code_block_6 = CodeBlock { "Specialty Equipment"; }
list_create = List.Create(item0=code_block_3, item1=code_block_4, item2=code_block_5, item3=code_block_6)
ne = fromObject != list_create@L1
transpose = List.Transpose(lists=ne)
code_block_7 = CodeBlock { 1; }
flatten_2 = List.Flatten(list=transpose, amt=code_block_7)
filterByBoolMask_2 = List.FilterByBoolMask(list=dimensionElements, mask=flatten_2)
clean = List.Clean(list=filterByBoolMask_2.in)
rank = List.Rank(list=flatten_2)
