# Dynamo graph GetElementsFromLinkModel.dyn (Dynamo 2.3.2.15696)
# packages: Synthesize toolkit 4.6.4, spring nodes 204.1.0, Modelical 2.2.19, bimorphNodes 3.0.3

al_get_documents = Custom[AL.Get Documents]()  # package Synthesize toolkit; Queries all linked Revit files and retrieves their Name, LinkInstance and Document properties.
code_block = CodeBlock(IN=al_get_documents.Link_Name) { IN[4]; }
code_block_2 = CodeBlock(IN=al_get_documents.Link_Instance) { IN[4]; }
categories = Categories("OST_Walls")
code_block_3 = CodeBlock { true; }
ꟿ_collect_linkedinstanceelements = Custom[ꟿ Collect.LinkedInstanceElements](linkInstance=code_block_2, CategoryOrType=categories, refresh=code_block_3)  # package spring nodes; Extract elements by category from the selected linked instances. The transform CS can be used to get the exact location of the elements in the host file. If an error occurs or the linked document is unloaded, an error will be returned in the elements output and the appropriate transform will be a null. You can use those nulls to filter out the errors.
flatten = List.Flatten(list=ꟿ_collect_linkedinstanceelements.elements)
name = Element.Name(element=flatten)
code_block_4 = CodeBlock { "L1"; }
code_block_5 = CodeBlock { false; }
startsWith = String.StartsWith(str=name, searchFor=code_block_4, ignoreCase=code_block_5)
filterByBoolMask = List.FilterByBoolMask(list=flatten, mask=startsWith)
name_2 = Element.Name(element=filterByBoolMask.in)
uniqueItems = List.UniqueItems(list=name_2)
selectInRevit = Custom[SelectInRevit]()  # package Modelical; Select elements in Revit by Element or ID; unwired: ElemsOrIDs
watch = Watch(filterByBoolMask.in)
ꟿ_selectinrevit = Custom[ꟿ SelectInRevit](element=watch)  # package spring nodes; Selects the input elements inside the Revit UI.
watch_2 = Watch(ꟿ_selectinrevit)
copyToActiveDocument = Revit.LinkElement.CopyToActiveDocument(linkElements=watch)
linkInstanceId = Revit.LinkElement.LinkInstanceId()  # unwired: linkElement
