# Dynamo graph GetHost.dyn (Dynamo 2.3.1.11775)
# packages: Clockwork for Dynamo 2.x 2.3.0, Modelical 2.2.19, spring nodes 204.1.0

boolean = BoolSelector(false)
ꟿ_collect_currentselection = Custom[ꟿ Collect.CurrentSelection](refresh=boolean)  # package spring nodes; Gets the currently selected elements. Connect a boolean switch to refresh the selection.
host = Custom[Element.Host+](element=ꟿ_collect_currentselection)  # package Clockwork for Dynamo 2.x; Gets an element's host. Unlike the OOTB node FamilyInstance.GetHost it not only works for family instances but also for elements like wall sweeps, foundations, railings, builing pads and topo subregions.
selectInRevit = Custom[SelectInRevit](ElemsOrIDs=host)  # package Modelical; Select elements in Revit by Element or ID
join = List.Join(list0=ꟿ_collect_currentselection, list1=host)
