# Dynamo graph GetLinkedTagsHost.dyn (Dynamo 2.3.2.15696)
# packages: Genius Loci 2021.7.30, Synthesize toolkit 4.6.4

file_path = Filename("C:\Users\bekinci\Documents\revit error\20230125_POD WINDOWS TAGS\SIR_Missing Pod Window Tags.csv")
string_from_object = FromObject(obj=file_path)

# group: READ EXCEL
file_path_2 = Filename("C:\Users\bekinci\Documents\revit error\20230125_POD WINDOWS TAGS\NewTag.xlsx")
file_from_path = FileObject(path=file_path_2)
code_block = CodeBlock { "Sheet1"; }
code_block_2 = CodeBlock { false; }
importExcel = Data.ImportExcel(file=file_from_path, sheetName=code_block, readAsStrings=code_block_2, showExcel=code_block_2)
flatten = List.Flatten(list=importExcel)
list_clean = Custom[List Clean](list=flatten)  # package Genius Loci; Removes all Null, Empty and Blank from a list or nested list of lists.
code_block_3 = CodeBlock(x=list_clean) { x:int[]; }

# group: SELECT CATEGORY
categories = Categories("OST_MultiCategoryTags")
python_script = Python(IN[0]=categories)
# ---------- python_script.python (35 lines) ----------
import clr

clr.AddReference("RevitServices")
from RevitServices.Persistence import DocumentManager
doc = DocumentManager.Instance.CurrentDBDocument

clr.AddReference("RevitAPI")
from Autodesk.Revit.DB import FilteredElementCollector

clr.AddReference("RevitNodes")
import Revit
clr.ImportExtensions(Revit.Elements)

def tolist(obj1):
	if hasattr(obj1,"__iter__"): return obj1
	else: return [obj1]

cat = UnwrapElement(IN[0])
OUT = []

ueWrapper = None
wrappers = clr.GetClrType(Revit.Elements.ElementWrapper).GetMethods()
for w in wrappers:
	if w.ToString().startswith("Revit.Elements.UnknownElement"):
		ueWrapper = w
		break

if ueWrapper is not None:
	fec = FilteredElementCollector(doc).WhereElementIsNotElementType()
	if cat is not None:
		fec = fec.OfCategoryId(cat.Id)
	view_el = []
	for e in fec:
		view_el.append(ueWrapper.Invoke(None, (e, True) ) )
	OUT.append(view_el)
# ----------------------------------------
flatten_2 = List.Flatten(list=python_script)
id = Element.Id(element=flatten_2)

setIntersection = List.SetIntersection(list1=code_block_3, list2=id)
contains = List.Contains(list=setIntersection@L2, item=id@L1, lacing=Longest)
filterByBoolMask = List.FilterByBoolMask(list=flatten_2, mask=contains)
flatten_3 = List.Flatten(list=filterByBoolMask.in)

# group: HOST ELEMENTS FROM LINK
al_get_documents = Custom[AL.Get Documents]()  # package Synthesize toolkit; Queries all linked Revit files and retrieves their Name, LinkInstance and Document properties.
code_block_4 = CodeBlock(x=al_get_documents.Link_Doc) { x[3]; }
tag_taggedelement = Custom[Tag TaggedElement](tag=flatten_3, docOrRevitLinkInstance=code_block_4)  # package Genius Loci; Get tagged element. Unlike the OOTB node it works also for linked element, linked room, room, space and area categories.
id_2 = Element.Id(element=tag_taggedelement)

list_create = List.Create(item0=setIntersection, item1=id_2)
transpose = List.Transpose(lists=list_create)
exportCSV = Data.ExportCSV(filePath=string_from_object, data=transpose)
