# Dynamo graph GetNonHostingWalls.dyn (Dynamo 2.3.2.15696)
# packages: Clockwork for Dynamo 2.x 2.3.0, Modelical 2.2.19

categories = Categories("OST_Windows")
all_elements_of_category = ElementsOfCategory(Category=categories)
host = Custom[Element.Host+](element=all_elements_of_category)  # package Clockwork for Dynamo 2.x; Gets an element's host. Unlike the OOTB node FamilyInstance.GetHost it not only works for family instances but also for elements like wall sweeps, foundations, railings, builing pads and topo subregions.
name = Element.Name(element=host)
categories_2 = Categories("OST_Walls")
all_elements_of_category_2 = ElementsOfCategory(Category=categories_2)
name_2 = Element.Name(element=all_elements_of_category_2)
code_block = CodeBlock { "_EWS(ARC)_30mm"; }
eq = name_2 == code_block
filterByBoolMask = List.FilterByBoolMask(list=all_elements_of_category_2, mask=eq)
categories_3 = Categories("OST_Doors")
all_elements_of_category_3 = ElementsOfCategory(Category=categories_3)
host_2 = Custom[Element.Host+](element=all_elements_of_category_3)
join = List.Join(list0=host, list1=host_2)
setDifference = List.SetDifference(list1=filterByBoolMask.in, list2=join)
selectInRevit = Custom[SelectInRevit](ElemsOrIDs=setDifference)  # package Modelical; Select elements in Revit by Element or ID
name_3 = Element.Name(element=host_2)
