# Dynamo graph GetSpotElevationByLocation.dyn (Dynamo 2.3.1.11775)
# packages: Clockwork for Dynamo 2.x 2.3.0

categories = Categories("OST_SpotElevations")
source_view_template = StringInput("30B_1 in 100 Concrete")  # graph input

# group: Source Views
categories_2 = Categories("OST_Sheets")
all_elements_of_category = ElementsOfCategory(Category=categories_2)
sheetNumber = Sheet.SheetNumber(sheet=all_elements_of_category)
code_block = CodeBlock { "30B"; }
contains = String.Contains(str=sheetNumber, searchFor=code_block)
filterByBoolMask = List.FilterByBoolMask(list=all_elements_of_category, mask=contains)
views = Sheet.Views(sheet=filterByBoolMask.in)
code_block_2 = CodeBlock { "View Template"; }
getParameterValueByName = Element.GetParameterValueByName(element=views, parameterName=code_block_2)
string_from_object = FromObject(obj=getParameterValueByName)
contains_2 = String.Contains(str=string_from_object, searchFor=source_view_template)
filterByBoolMask_2 = List.FilterByBoolMask(list=views, mask=contains_2)
type = Custom[View.Type](view=filterByBoolMask_2.in@L2)  # package Clockwork for Dynamo 2.x; Returns the type of a given view
string_from_object_2 = FromObject(obj=type)
code_block_3 = CodeBlock { "FloorPlan"; }
contains_3 = String.Contains(str=string_from_object_2, searchFor=code_block_3)
filterByBoolMask_3 = List.FilterByBoolMask(list=filterByBoolMask_2.in, mask=contains_3)

all_elements_of_category_in_view = ElementsOfCategoryInView(Category=categories, View=filterByBoolMask_3.in)
getLocation = Element.GetLocation(element=all_elements_of_category_in_view@L2)
X = Point.X(point=getLocation)
sortIndexByValue = List.SortIndexByValue(list=X)
reorder = List.Reorder(list=all_elements_of_category_in_view, indices=sortIndexByValue)
code_block_4 = CodeBlock { "Single/Upper Value"; }
getParameterValueByName_2 = Element.GetParameterValueByName(element=reorder, parameterName=code_block_4)
target_view_template = StringInput("32B-1 in 100")  # graph input

# group: Target Views
categories_3 = Categories("OST_Sheets")
all_elements_of_category_2 = ElementsOfCategory(Category=categories_3)
sheetNumber_2 = Sheet.SheetNumber(sheet=all_elements_of_category_2)
code_block_5 = CodeBlock { "32B"; }
contains_4 = String.Contains(str=sheetNumber_2, searchFor=code_block_5)
filterByBoolMask_4 = List.FilterByBoolMask(list=all_elements_of_category_2, mask=contains_4)
views_2 = Sheet.Views(sheet=filterByBoolMask_4.in)
code_block_6 = CodeBlock { "View Template"; }
getParameterValueByName_3 = Element.GetParameterValueByName(element=views_2, parameterName=code_block_6)
string_from_object_3 = FromObject(obj=getParameterValueByName_3)
contains_5 = String.Contains(str=string_from_object_3, searchFor=target_view_template)
filterByBoolMask_5 = List.FilterByBoolMask(list=views_2, mask=contains_5)
type_2 = Custom[View.Type](view=filterByBoolMask_5.in@L2)
string_from_object_4 = FromObject(obj=type_2)
code_block_7 = CodeBlock { "FloorPlan"; }
contains_6 = String.Contains(str=string_from_object_4, searchFor=code_block_7)
filterByBoolMask_6 = List.FilterByBoolMask(list=filterByBoolMask_5.in, mask=contains_6)
