# Dynamo graph HideGroupsbyViewTemplate.dyn (Dynamo 2.3.1.11775)
# packages: Clockwork for Dynamo 2.x 2.3.0, archi-lab.net 2019.2.25, Genius Loci 2021.7.30

element_types = ElementTypes("Group")
all_elements_of_type = ElementsOfType(element_type=element_types)
name = Custom[Element.Name+](element=all_elements_of_type)  # package Clockwork for Dynamo 2.x; Gets an element's name. Unlike the OOTB node, this node should work for all Revit elements that have names and will also return the localized names of system parameters, parameter groups, display unit types, parameter types, unit symbol types and unit types.
views = Custom[Document.Views]()  # package Clockwork for Dynamo 2.x; Gets all views in the document - except for 3D view templates (as long as this bug is not fixed: https://github.com/DynamoDS/Dynamo/issues/2970)
code_block = CodeBlock { "View Template"; }
getParameterValueByName = Element.GetParameterValueByName(element=views, parameterName=code_block)
string_from_object = FromObject(obj=getParameterValueByName)
code_block_2 = CodeBlock { "30B_1 in 100 Concrete"; }
contains = String.Contains(str=string_from_object, searchFor=code_block_2)
filterByBoolMask = List.FilterByBoolMask(list=views, mask=contains)
selectByCateOrTypeAndView = Custom[SelectByCateOrTypeAndView](view=filterByBoolMask.in, CategoryOrType=element_types)  # package Genius Loci; Collects elements by Category, Element Type or Family Type and View in the active or given document.
name_2 = Custom[Element.Name+](element=selectByCateOrTypeAndView@L2)
code_block_3 = CodeBlock { ["CORE 3_NORTH LIVING MECH","BEDROOM MECH","PENO_TYP BATHROOM_TYPE"]; }
contains_2 = Custom[String.Contains](StringList=name_2@L2, FilterList=code_block_3)  # package archi-lab.net; This node takes a list of strings and checks if any string contains a matching string from filter input.
filterByBoolMask_2 = List.FilterByBoolMask(list=selectByCateOrTypeAndView, mask=contains_2)
boolean = BoolSelector(true)
hideElements = Custom[View.HideElements](Element=filterByBoolMask_2.in@L2, View=filterByBoolMask.in, RunIt=boolean)  # package archi-lab.net; This node will hide elements in specified view.
firstItem = List.FirstItem()  # unwired: list
create_overridegraphicsettings = Custom[Create OverrideGraphicSettings]()  # package Genius Loci; Create a OverrideGraphicSettings (All graphic inputs are optional). Unlike the OOTB OverrideGraphicSettings.ByProperties node, the Foreground and background patterns are available. Note : Prior to Revit 2019, the materials have only one surface pattern and one cut pattern.
select_model_element = DSModelElementSelection()  # 1 picked in the model
code_block_4 = CodeBlock { true; }
overrideInView = Element.OverrideInView(element=select_model_element, hide=code_block_4)  # unwired: overrides
byProperties = Revit.Filter.OverrideGraphicSettings.ByProperties()
get_all_detail_groups = Custom[Get All Detail Groups]()  # package archi-lab.net; This node will retrieve all instances of Detail Groups in the model.
type = archilab.Revit.Elements.Elements.Type(element=get_all_detail_groups.Groups)
name_3 = Custom[Element.Name+](element=type)
contains_3 = Custom[String.Contains](StringList=name_3, FilterList=code_block_3)
filterByBoolMask_3 = List.FilterByBoolMask(list=type, mask=contains_3)
name_4 = Custom[Element.Name+](element=filterByBoolMask_3.in)
uniqueItems = List.UniqueItems(list=type)
code_block_5 = CodeBlock { "Type"; }
getParameterValueByName_2 = Element.GetParameterValueByName(element=all_elements_of_type, parameterName=code_block_5)
delete = Element.Delete()  # unwired: element
convertTemporaryHideIsolateToPermanent = Custom[View.ConvertTemporaryHideIsolateToPermanent]()  # package Clockwork for Dynamo 2.x; Convert all temporary hidden elements or categories to permanently hidden in the given view.; unwired: view
convertToIndependent = Custom[View.ConvertToIndependent]()  # package Clockwork for Dynamo 2.x; Converts a given dependent view to an independent view; unwired: view
