# Dynamo graph LevelHeadsVisibility.dyn "DY PL Levels Hide or Show Bubble Left or Right (checkbox on or of)" (Dynamo 2.3.1.11775)
# packages: spring nodes 204.1.0, archi-lab.net 2019.2.25

categories_levels = Categories("OST_Levels")  # graph input
boolean_change_to_run_again = BoolSelector(false)
activeView = Custom[Springs.Doc.ActiveView](refresh=boolean_change_to_run_again)  # package spring nodes; Selects the current document's active view. Supports more view types than the built-in option. Will be depreciated once the bult in node works with all plan types.
byCategoryAndView = archilab.Revit.Selection.Select.ByCategoryAndView(category=categories_levels, view=activeView)
boolean_true_left_bubble_on = BoolSelector(false)  # "Boolean (True=Left Bubble on, False is Right Bubble on)"; graph input
python_script_toggle_between = Python(IN[0]=byCategoryAndView, IN[1]=activeView, IN[2]=boolean_true_left_bubble_on)  # "Python Script (Toggle between Hide and show Left or Right Level bubble )"
# ---------- python_script_toggle_between.python (32 lines) ----------
import clr
clr.AddReference('RevitAPI')
from Autodesk.Revit.DB import *
import Autodesk

clr.AddReference("RevitServices")
import RevitServices
from RevitServices.Persistence import DocumentManager
from RevitServices.Transactions import TransactionManager

doc = DocumentManager.Instance.CurrentDBDocument
uiapp = DocumentManager.Instance.CurrentUIApplication
app = uiapp.Application

a = UnwrapElement(IN[0])
v = UnwrapElement(IN[1])
b = UnwrapElement(IN[2])
TransactionManager.Instance.EnsureInTransaction(doc)

for i in a:
	if b:
		i.ShowBubbleInView(DatumEnds.End0,v)
		i.HideBubbleInView(DatumEnds.End1,v)

	else:
		i.HideBubbleInView(DatumEnds.End0,v)
		i.ShowBubbleInView(DatumEnds.End1,v)

TransactionManager.Instance.TransactionTaskDone()

#Assign your output to the OUT variable.
OUT = 0
# ----------------------------------------
python_script_show_level_bubble = Python()  # "Python Script (Show Level bubble Left and Hide Level Bubble Right)"; frozen; unwired: IN[0], IN[1]
# ---------- python_script_show_level_bubble.python (25 lines) ----------
import clr
clr.AddReference('RevitAPI')
from Autodesk.Revit.DB import *
import Autodesk

clr.AddReference("RevitServices")
import RevitServices
from RevitServices.Persistence import DocumentManager
from RevitServices.Transactions import TransactionManager

doc = DocumentManager.Instance.CurrentDBDocument
uiapp = DocumentManager.Instance.CurrentUIApplication
app = uiapp.Application

a = UnwrapElement(IN[0])
v = UnwrapElement(IN[1])
TransactionManager.Instance.EnsureInTransaction(doc)

for i in a:
	i.ShowBubbleInView(DatumEnds.End0,v)
	i.HideBubbleInView(DatumEnds.End1,v)
TransactionManager.Instance.TransactionTaskDone()

#Assign your output to the OUT variable.
OUT = 0
# ----------------------------------------
