# Dynamo graph MepAddCommentToVerticalElements.dyn (Dynamo 2.3.2.15696)

categories = Categories("OST_DuctCurves")
categories_2 = Categories("OST_PipeCurves")
join = List.Join(list0=categories_2)  # unwired: list1, list2
all_elements_of_category = ElementsOfCategory(Category=categories_2)
code_block = CodeBlock { "Slope"; }
getParameterValueByName = Element.GetParameterValueByName(element=all_elements_of_category, parameterName=code_block)
string_from_object = FromObject(obj=getParameterValueByName)
code_block_2 = CodeBlock { ""; }
eq = string_from_object == code_block_2
filterByBoolMask = List.FilterByBoolMask(list=all_elements_of_category, mask=eq)
categories_3 = Categories("OST_PipeCurves")
all_elements_of_category_2 = ElementsOfCategory(Category=categories_3)
code_block_3 = CodeBlock { "Length"; }
getParameterValueByName_2 = Element.GetParameterValueByName(element=all_elements_of_category_2, parameterName=code_block_3)
code_block_4 = CodeBlock { 1200; }
lt = getParameterValueByName_2 < code_block_4
filterByBoolMask_2 = List.FilterByBoolMask(list=all_elements_of_category_2, mask=lt)
setDifference = List.SetDifference(list1=filterByBoolMask.in, list2=filterByBoolMask_2.in)
code_block_5 = CodeBlock { "Comments"; }

# group: CHANGE THIS
code_block_6 = CodeBlock { "FIRE-VERTICAL"; }

setParameterByName = Element.SetParameterByName(element=setDifference, parameterName=code_block_5, value=code_block_6)
categories_4 = Categories("OST_CableTray")
code_block_7 = CodeBlock { ""; }
