# Dynamo graph OverrideElementsByParameter.dyn (Dynamo 2.3.2.15696)

color_range = ColorRange()  # unwired: colors, indices, value
code_block = CodeBlock { "Lot Number"; }
code_block_2 = CodeBlock { "0"; }
setParameterByName = Element.SetParameterByName(parameterName=code_block, value=code_block_2)  # unwired: element
categories = Categories("OST_Ceilings")
views = Views("CEILING AFFL")
all_elements_of_category_in_view = ElementsOfCategoryInView(Category=categories, View=views)
getParameterValueByName = Element.GetParameterValueByName(element=all_elements_of_category_in_view, parameterName=code_block)
code_block_3 = CodeBlock { "0"; }
eq = getParameterValueByName == code_block_3
filterByBoolMask = List.FilterByBoolMask(list=all_elements_of_category_in_view, mask=eq)
code_block_4 = CodeBlock { "Lot Number"; }
getParameterValueByName_2 = Element.GetParameterValueByName(element=filterByBoolMask.out, parameterName=code_block_4)
toNumber = String.ToNumber(str=getParameterValueByName_2)
code_block_5 = CodeBlock { 255; }
random = Math.Random(value1=toNumber, value2=code_block_5)
code_block_6 = CodeBlock { 0.97; }
mul = random * code_block_6
random_2 = Math.Random(seed=toNumber, lacing=CrossProduct)
code_block_7 = CodeBlock { 1.07; }
mul_2 = random_2 * code_block_7
code_block_8 = CodeBlock { 0.89; }
mul_3 = random_2 * code_block_8
byARGB = Color.ByARGB(r=mul, g=mul_2, b=mul_3)
overrideColorInView = Element.OverrideColorInView(element=filterByBoolMask.in, color=byARGB)
list_create = List.Create(item0=mul, item1=mul_2, item2=mul_3)
shuffle = List.Shuffle(list=list_create)
flatten = List.Flatten(list=shuffle)
code_block_9 = CodeBlock { 3; }
chop = List.Chop(list=flatten, lengths=code_block_9)
