# Dynamo graph ReconcileTags.dyn (Dynamo 2.3.2.15696)
# packages: Clockwork for Dynamo 2.x 2.3.0, Synthesize toolkit 4.6.4, Genius Loci 2021.7.30, Modelical 2.2.19

file_path = Filename("C:\Users\bekinci\Documents\revit error\20230125_POD WINDOWS TAGS\SIR_Missing Pod Window Tags.csv")
importCSV = Data.ImportCSV(filePath=file_path)
lastItem = List.LastItem(list=importCSV)
code_block = CodeBlock(x=lastItem) { x:int[]; }
al_get_documents = Custom[AL.Get Documents]()  # package Synthesize toolkit; Queries all linked Revit files and retrieves their Name, LinkInstance and Document properties.
code_block_2 = CodeBlock(x=al_get_documents.Link_Instance) { x[3]; }
byID = Custom[Element.ByID](IdOrUniqueId=code_block, docOrRevitLinkInstance=code_block_2)  # package Clockwork for Dynamo 2.x; Gets the Revit element(s) for a list of IDs (or a single ID). Optionally retrieves elements from linked documents as well.

# group: SELECT CATEGORY
categories = Categories("OST_MultiCategoryTags")
python_script = Python(IN[0]=categories)
# ---------- python_script.python (35 lines) ----------
import clr

clr.AddReference("RevitServices")
from RevitServices.Persistence import DocumentManager
doc = DocumentManager.Instance.CurrentDBDocument

clr.AddReference("RevitAPI")
from Autodesk.Revit.DB import FilteredElementCollector

clr.AddReference("RevitNodes")
import Revit
clr.ImportExtensions(Revit.Elements)

def tolist(obj1):
	if hasattr(obj1,"__iter__"): return obj1
	else: return [obj1]

cat = UnwrapElement(IN[0])
OUT = []

ueWrapper = None
wrappers = clr.GetClrType(Revit.Elements.ElementWrapper).GetMethods()
for w in wrappers:
	if w.ToString().startswith("Revit.Elements.UnknownElement"):
		ueWrapper = w
		break

if ueWrapper is not None:
	fec = FilteredElementCollector(doc).WhereElementIsNotElementType()
	if cat is not None:
		fec = fec.OfCategoryId(cat.Id)
	view_el = []
	for e in fec:
		view_el.append(ueWrapper.Invoke(None, (e, True) ) )
	OUT.append(view_el)
# ----------------------------------------
flatten = List.Flatten(list=python_script)
id = Element.Id(element=flatten)

firstItem = List.FirstItem(list=importCSV)
setIntersection = List.SetIntersection(list1=id, list2=firstItem)
contains = List.Contains(list=setIntersection@L2, item=id@L1, lacing=Longest)
filterByBoolMask = List.FilterByBoolMask(list=flatten, mask=contains)
flatten_2 = List.Flatten(list=filterByBoolMask.in)
tag_isorphaned = Custom[Tag IsOrphaned](tag=flatten_2)  # package Genius Loci; Identify the orphaned tags. Orphaned tags are tags that are associated with a linked document but no longer have a host element.
selectInRevit = Custom[SelectInRevit](ElemsOrIDs=flatten_2)  # package Modelical; Select elements in Revit by Element or ID
