# Dynamo graph SIRIUS_SheetPackageByDBPA.dyn (Dynamo 2.3.2.15696)
# packages: Data-Shapes 2021.2.94

string = StringInput("Sheet Drawing Packages")
string_2 = StringInput("CC3")
setParameterByName = Element.SetParameterByName(parameterName=string, value=string_2)  # unwired: element
categories = Categories("OST_Sheets")
all_elements_of_category = ElementsOfCategory(Category=categories)
sheet_Titleblock = Custom[Sheet_Titleblock](Sheet=all_elements_of_category)  # package Data-Shapes; Gets the titleblock used in a Sheet
string_3 = StringInput("DBPA_Date1")
getParameterValueByName = Element.GetParameterValueByName(element=sheet_Titleblock.TitleBlock_FamilyInstance, parameterName=string_3)
string_4 = StringInput("25/11/2022")
eq = getParameterValueByName == string_4
filterByBoolMask = List.FilterByBoolMask(list=all_elements_of_category, mask=eq)
ne = getParameterValueByName != string_4
getParameterValueByName_2 = Element.GetParameterValueByName(element=all_elements_of_category, parameterName=string)
string_5 = StringInput("CC3")
contains = String.Contains(str=getParameterValueByName_2, searchFor=string_5)
filterByBoolMask_2 = List.FilterByBoolMask(list=all_elements_of_category, mask=contains)
