# Dynamo graph SelectBeamsDisallowJoin.dyn (Dynamo 2.3.1.11775)
# packages: Modelical 2.2.19

select_model_elements = DSModelElementsSelection()  # 12 picked in the model; graph input
code_block = CodeBlock { true; }
disallowAllowJoinInSTRFraming = Custom[DisallowAllowJoinInSTRFraming](strFraming=select_model_elements, TrueFalse=code_block)  # package Modelical; Disallow or allow join condition at Structural Framing ends (True = Disallow | False = Allow)
