# Dynamo graph SetViewScopeBoxBySheet.dyn (Dynamo 2.3.2.15696)
# packages: Rhythm 2019.9.12

categories = Categories("OST_Sheets")
all_elements_of_category = ElementsOfCategory(Category=categories)
sheetNumber = Sheet.SheetNumber(sheet=all_elements_of_category)
code_block = CodeBlock { "12B"; }
startsWith = String.StartsWith(str=sheetNumber, searchFor=code_block)
filterByBoolMask = List.FilterByBoolMask(list=all_elements_of_category, mask=startsWith)
views = Sheet.Views(sheet=filterByBoolMask.in)
name = Element.Name(element=views)
code_block_2 = CodeBlock { "ZONE 5"; }
contains = String.Contains(str=name, searchFor=code_block_2)
filterByBoolMask_2 = List.FilterByBoolMask(list=views, mask=contains)
flatten = List.Flatten(list=filterByBoolMask_2.in)
code_block_3 = CodeBlock { -5; }
dropItems = List.DropItems(list=flatten, amount=code_block_3)
code_block_4 = CodeBlock { "Scope Box"; }
scope_boxes = ScopeBoxes("B12-Core 05")
setParameterByName = Element.SetParameterByName(element=dropItems, parameterName=code_block_4, value=scope_boxes)
