# Dynamo graph SheetByRevision.dyn (Dynamo 2.3.2.15696)
# packages: Genius Loci 2021.7.30

code_block = CodeBlock { "Sheet Drawing Packages"; }
code_block_2 = CodeBlock { "CC4"; }
setParameterByName = Element.SetParameterByName(parameterName=code_block, value=code_block_2)  # unwired: element
select_revision = RevitRevisions("Seq. 134 (Issued) - CC4 COORDINATION")
revision_tosheet = Custom[Revision ToSheet](revision=select_revision)  # package Genius Loci; Returns the ViewSheets where this Revision participates in the sheet's revision schedule.
getParameterValueByName = Element.GetParameterValueByName(element=revision_tosheet, parameterName=code_block)
sheetNumber = Sheet.SheetNumber(sheet=revision_tosheet)
sort = List.Sort(list=sheetNumber)
