# Dynamo graph SpotElevationViewToView.dyn (Dynamo 2.3.1.11775)
# packages: Clockwork for Dynamo 2.x 2.3.0, spring nodes 204.1.0

# group: INPUT
code_block = CodeBlock { "30B_1 in 100 Concrete"; }

# group: SOURCE VIEW
views = Custom[Document.Views]()  # package Clockwork for Dynamo 2.x; Gets all views in the document - except for 3D view templates (as long as this bug is not fixed: https://github.com/DynamoDS/Dynamo/issues/2970)
code_block_2 = CodeBlock { "View Template"; }
getParameterValueByName = Element.GetParameterValueByName(element=views, parameterName=code_block_2)
string_from_object = FromObject(obj=getParameterValueByName)
contains = String.Contains(str=string_from_object, searchFor=code_block)
filterByBoolMask = List.FilterByBoolMask(list=views, mask=contains)

# group: INPUT
code_block_3 = CodeBlock { "32B-1 in 100"; }

# group: TARGET VIEW
views_2 = Custom[Document.Views]()
code_block_4 = CodeBlock { "View Template"; }
getParameterValueByName_2 = Element.GetParameterValueByName(element=views_2, parameterName=code_block_4)
string_from_object_2 = FromObject(obj=getParameterValueByName_2)
contains_2 = String.Contains(str=string_from_object_2, searchFor=code_block_3)
filterByBoolMask_2 = List.FilterByBoolMask(list=views_2, mask=contains_2)

source_view_template = StringInput("30B_1 in 100 Concrete")  # graph input

# group: Source Views
categories = Categories("OST_Sheets")
all_elements_of_category = ElementsOfCategory(Category=categories)
sheetNumber = Sheet.SheetNumber(sheet=all_elements_of_category)
code_block_5 = CodeBlock { "30B"; }
contains_3 = String.Contains(str=sheetNumber, searchFor=code_block_5)
filterByBoolMask_3 = List.FilterByBoolMask(list=all_elements_of_category, mask=contains_3)
views_3 = Sheet.Views(sheet=filterByBoolMask_3.in)
code_block_6 = CodeBlock { "View Template"; }
getParameterValueByName_3 = Element.GetParameterValueByName(element=views_3, parameterName=code_block_6)
string_from_object_3 = FromObject(obj=getParameterValueByName_3)
contains_4 = String.Contains(str=string_from_object_3, searchFor=source_view_template)
filterByBoolMask_4 = List.FilterByBoolMask(list=views_3, mask=contains_4)
type = Custom[View.Type](view=filterByBoolMask_4.in@L2)  # package Clockwork for Dynamo 2.x; Returns the type of a given view
string_from_object_4 = FromObject(obj=type)
code_block_7 = CodeBlock { "FloorPlan"; }
contains_5 = String.Contains(str=string_from_object_4, searchFor=code_block_7)
filterByBoolMask_5 = List.FilterByBoolMask(list=filterByBoolMask_4.in, mask=contains_5)

code_block_8 = CodeBlock { false; }
clean = List.Clean(list=filterByBoolMask_5.in, preserveIndices=code_block_8)
flatten = List.Flatten(list=clean)
name = Element.Name()  # unwired: element
sortByFunction = List.SortByFunction(list=flatten, func=name)
name_2 = Custom[Element.Name+](element=sortByFunction)  # package Clockwork for Dynamo 2.x; Gets an element's name. Unlike the OOTB node, this node should work for all Revit elements that have names and will also return the localized names of system parameters, parameter groups, display unit types, parameter types, unit symbol types and unit types.
code_block_9 = CodeBlock { "30B-B01-101_1 LEVEL 01-02_LOT 6 - UPPER"; }
contains_6 = String.Contains(str=name_2, searchFor=code_block_9)
filterByBoolMask_6 = List.FilterByBoolMask(list=sortByFunction, mask=contains_6)
target_view_template = StringInput("32B-1 in 100")  # graph input

# group: Target Views
categories_2 = Categories("OST_Sheets")
all_elements_of_category_2 = ElementsOfCategory(Category=categories_2)
sheetNumber_2 = Sheet.SheetNumber(sheet=all_elements_of_category_2)
code_block_10 = CodeBlock { "32B"; }
contains_7 = String.Contains(str=sheetNumber_2, searchFor=code_block_10)
filterByBoolMask_7 = List.FilterByBoolMask(list=all_elements_of_category_2, mask=contains_7)
views_4 = Sheet.Views(sheet=filterByBoolMask_7.in)
code_block_11 = CodeBlock { "View Template"; }
getParameterValueByName_4 = Element.GetParameterValueByName(element=views_4, parameterName=code_block_11)
string_from_object_5 = FromObject(obj=getParameterValueByName_4)
contains_8 = String.Contains(str=string_from_object_5, searchFor=target_view_template)
filterByBoolMask_8 = List.FilterByBoolMask(list=views_4, mask=contains_8)
type_2 = Custom[View.Type](view=filterByBoolMask_8.in@L2)
string_from_object_6 = FromObject(obj=type_2)
code_block_12 = CodeBlock { "FloorPlan"; }
contains_9 = String.Contains(str=string_from_object_6, searchFor=code_block_12)
filterByBoolMask_9 = List.FilterByBoolMask(list=filterByBoolMask_8.in, mask=contains_9)

code_block_13 = CodeBlock { false; }
clean_2 = List.Clean(list=filterByBoolMask_9.in, preserveIndices=code_block_13)
flatten_2 = List.Flatten(list=clean_2)
name_3 = Element.Name()  # unwired: element
sortByFunction_2 = List.SortByFunction(list=flatten_2, func=name_3)
categories_3 = Categories("OST_RoomTags")
all_elements_of_category_in_view = ElementsOfCategoryInView(Category=categories_3, View=filterByBoolMask_6.out)
ꟿ_document_copyfromviewtoview = Custom[ꟿ Document.CopyFromViewToView](sourceView=filterByBoolMask_6.out, destView=sortByFunction_2, elements=all_elements_of_category_in_view)  # package spring nodes; The node will copy the input (view based) elements from the source view into the destination view.
