# Dynamo graph StructuralFramingDisallowJoin.dyn (Dynamo 2.3.1.11775)
# packages: Modelical 2.2.19

categories = Categories("OST_StructuralFraming")
all_elements_of_category = ElementsOfCategory(Category=categories)

# group: CHANGE IF NEEDED
code_block = CodeBlock { "Type"; }

getParameterValueByName = Element.GetParameterValueByName(element=all_elements_of_category, parameterName=code_block)
string_from_object = FromObject(obj=getParameterValueByName)

# group: CHANGE IF NEEDED
code_block_2 = CodeBlock { "PB"; }

code_block_3 = CodeBlock { true; }
contains = String.Contains(str=string_from_object, searchFor=code_block_2, ignoreCase=code_block_3)
filterByBoolMask = List.FilterByBoolMask(list=all_elements_of_category, mask=contains)
disallowAllowJoinInSTRFraming = Custom[DisallowAllowJoinInSTRFraming](strFraming=filterByBoolMask.in, TrueFalse=code_block_3)  # package Modelical; Disallow or allow join condition at Structural Framing ends (True = Disallow | False = Allow)
