# Dynamo graph TagRoomByViewTemplate.dyn (Dynamo 2.3.1.11775)
# packages: Clockwork for Dynamo 2.x 2.3.0, archi-lab.net 2019.2.25

views = Custom[Document.Views]()  # package Clockwork for Dynamo 2.x; Gets all views in the document - except for 3D view templates (as long as this bug is not fixed: https://github.com/DynamoDS/Dynamo/issues/2970)
code_block = CodeBlock { "View Template"; }
getParameterValueByName = Element.GetParameterValueByName(element=views, parameterName=code_block)
string_from_object = FromObject(obj=getParameterValueByName)

# group: INPUT
code_block_2 = CodeBlock { "30B_1 in 50 Concrete"; }

contains = String.Contains(str=string_from_object, searchFor=code_block_2)
filterByBoolMask = List.FilterByBoolMask(list=views, mask=contains)
isOnSheet = archilab.Revit.Views.Views.IsOnSheet(view=filterByBoolMask.in)
filterByBoolMask_2 = List.FilterByBoolMask(list=filterByBoolMask.in, mask=isOnSheet)
categories = Categories("OST_Rooms")
all_elements_of_category_in_view = ElementsOfCategoryInView(Category=categories, View=filterByBoolMask_2.in)
code_block_3 = CodeBlock { "Lot_Number"; }
getParameterValueByName_2 = Element.GetParameterValueByName(element=all_elements_of_category_in_view, parameterName=code_block_3)
code_block_4 = CodeBlock { ""; }
ne = getParameterValueByName_2 != code_block_4
filterByBoolMask_3 = List.FilterByBoolMask(list=all_elements_of_category_in_view, mask=ne)
getLocation = Element.GetLocation(element=filterByBoolMask_3.in)
code_block_5 = CodeBlock { true; }
code_block_6 = CodeBlock { false; }
byElementAndLocation = Tag.ByElementAndLocation(view=filterByBoolMask_2.in, element=filterByBoolMask_3.in, location=getLocation, horizontal=code_block_5, addLeader=code_block_6)  # frozen
X = Point.X(point=getLocation)
code_block_7 = CodeBlock { "0"; }
byElement = Tag.ByElement(view=filterByBoolMask_2.in, element=filterByBoolMask_3.in, horizontal=code_block_5, addLeader=code_block_6, horizontalAlignment=code_block_7, verticalAlignment=code_block_7, isOffset=code_block_6)  # frozen
delete = Element.Delete()  # unwired: element
categories_2 = Categories("OST_SpotElevations")
all_elements_of_category_in_view_2 = ElementsOfCategoryInView(Category=categories_2, View=filterByBoolMask_2.in)
name = Element.Name(element=all_elements_of_category_in_view_2)
code_block_8 = CodeBlock { "Spot Elevation_plan-meter X.XX LSL_LevellingScreed"; }
contains_2 = String.Contains(str=name, searchFor=code_block_8)
filterByBoolMask_4 = List.FilterByBoolMask(list=all_elements_of_category_in_view_2, mask=contains_2)
flatten = List.Flatten(list=filterByBoolMask_4.in)
delete_2 = archilab.Revit.Elements.Elements.Delete(element=flatten)
