# Dynamo graph TagStairByRoom.dyn (Dynamo 2.3.1.11775)
# packages: Genius Loci 2021.7.30

categories = Categories("OST_Rooms")
all_elements_of_category = ElementsOfCategory(Category=categories)
filterByBoolMask = List.FilterByBoolMask(list=all_elements_of_category)  # unwired: mask
area = Room.Area(room=filterByBoolMask.in)
code_block = CodeBlock { 0; }
gt = area > code_block
filterByBoolMask_2 = List.FilterByBoolMask(list=filterByBoolMask.in, mask=gt)
name = Element.Name()  # unwired: element
sortByFunction = List.SortByFunction(list=filterByBoolMask_2.in, func=name)
name_2 = Element.Name(element=sortByFunction)
groupByKey = List.GroupByKey(list=sortByFunction, keys=name_2)
boundingBox = Element.BoundingBox(element=groupByKey.groups)
code_block_2 = CodeBlock { "Lot_Number"; }
getParameterValueByName = Element.GetParameterValueByName(element=all_elements_of_category, parameterName=code_block_2)
list_clean = Custom[List Clean](list=getParameterValueByName)  # package Genius Loci; Removes all Null, Empty and Blank from a list or nested list of lists.
