# Dynamo graph TitleblockByRevision.dyn (Dynamo 2.3.1.11775)
# packages: Genius Loci 2021.7.30, Data-Shapes 2021.2.94

select_revision = RevitRevisions("Seq. 238 - FOR INFORMATION")
revision_tosheet = Custom[Revision ToSheet](revision=select_revision)  # package Genius Loci; Returns the ViewSheets where this Revision participates in the sheet's revision schedule.
name = Element.Name(element=revision_tosheet)
code_block = CodeBlock { "CONCRETE"; }
contains = String.Contains(str=name, searchFor=code_block)
filterByBoolMask = List.FilterByBoolMask(list=revision_tosheet, mask=contains)
sheet_Titleblock = Custom[Sheet_Titleblock](Sheet=filterByBoolMask.in)  # package Data-Shapes; Gets the titleblock used in a Sheet
code_block_2 = CodeBlock { "NOT_IN_USE"; }
getParameterValueByName = Element.GetParameterValueByName(element=sheet_Titleblock.TitleBlock_FamilyInstance, parameterName=code_block_2)
code_block_3 = CodeBlock { 1; }
setParameterByName = Element.SetParameterByName(element=sheet_Titleblock.TitleBlock_FamilyInstance, parameterName=code_block_2, value=code_block_3)
sheetTitleblock = Custom[SheetTitleblock]()  # package Data-Shapes; Get the TitleBlock family type from a sheet; unwired: sheet
