# Dynamo graph TurnoffPreviousRevCloud.dyn (Dynamo 2.3.2.15696)
# packages: Genius Loci 2021.7.30, Clockwork for Dynamo 2.x 2.3.0

categories = Categories("OST_Sheets")
all_elements_of_category = ElementsOfCategory(Category=categories)

# group: INPUT
parameter_name = StringInput("Appears In Sheet List")  # graph input

getParameterValueByName = Element.GetParameterValueByName(element=all_elements_of_category, parameterName=parameter_name)
code_block = CodeBlock { 1; }
eq = getParameterValueByName == code_block
filterByBoolMask = List.FilterByBoolMask(list=all_elements_of_category, mask=eq)

# group: INPUT
parameter_name_2 = StringInput("Sheet Drawing Packages")  # graph input

getParameterValueByName_2 = Element.GetParameterValueByName(element=filterByBoolMask.in, parameterName=parameter_name_2)

# group: INPUT
parameter_value = StringInput("CC3")  # graph input

eq_2 = getParameterValueByName_2 == parameter_value
filterByBoolMask_2 = List.FilterByBoolMask(list=filterByBoolMask.in, mask=eq_2)
sheet_torevision = Custom[Sheet ToRevision](sheet=filterByBoolMask.in)  # package Genius Loci; Returns the revision of the given sheet.

# group: INPUT
select_revision = RevitRevisions("Seq. 660 - FOR CONSTRUCTION")  # graph input

name = Element.Name(element=select_revision)
ne = sheet_torevision.RevisionName != name
filterByBoolMask_3 = List.FilterByBoolMask(list=sheet_torevision.Revision, mask=ne)
flatten = List.Flatten(list=filterByBoolMask_3.in)
uniqueItems = List.UniqueItems(list=flatten)
select_revision_visibility = RevisionVisibility("Hidden")
python_script = Python(IN[0]=uniqueItems, IN[1]=select_revision_visibility)
# ---------- python_script.python (29 lines) ----------
#Dynamo Forum 15993
import clr
clr.AddReference('RevitAPI')
import Autodesk
from Autodesk.Revit.DB import *
import System

clr.AddReference('RevitNodes')
import Revit
clr.ImportExtensions(Revit.Elements)

clr.AddReference('RevitServices')
import RevitServices
from RevitServices.Persistence import DocumentManager
from RevitServices.Transactions import TransactionManager
doc = DocumentManager.Instance.CurrentDBDocument

revisions = UnwrapElement(IN[0])

vis = System.Enum.Parse(Autodesk.Revit.DB.RevisionVisibility, IN[1])

TransactionManager.Instance.EnsureInTransaction(doc)

for r in revisions:
	newvis = r.Visibility = vis

TransactionManager.Instance.TransactionTaskDone()

OUT = revisions, [v.Visibility for v in revisions]
# ----------------------------------------
type = Object.Type(obj=select_revision_visibility)
name_2 = Custom[Element.Name+](element=uniqueItems)  # package Clockwork for Dynamo 2.x; Gets an element's name. Unlike the OOTB node, this node should work for all Revit elements that have names and will also return the localized names of system parameters, parameter groups, display unit types, parameter types, unit symbol types and unit types.
