# Dynamo graph WIP-SolveOverlapingLines.dyn (Dynamo 2.3.2.15696)
# packages: Clockwork for Dynamo 2.x 2.3.0, spring nodes 204.1.0, designtech 1.0.8

code_block = CodeBlock { 33010044; }
byID = Custom[Element.ByID](IdOrUniqueId=code_block)  # package Clockwork for Dynamo 2.x; Gets the Revit element(s) for a list of IDs (or a single ID). Optionally retrieves elements from linked documents as well.
location = Custom[Element.Location+](element=byID)  # package Clockwork for Dynamo 2.x; Returns the location of an element as point, curve or curve loop, along with some booleans to help filtering the results. Unlike the OOTB Element.GetLocation node, it also retunrs sketch lines of sketch-based elements like floor slabs as well as the element's rotation property.
ꟿ_list_firstlast = Custom[ꟿ List.FirstLast](list=location.curveEndpoints@L2)  # package spring nodes; Simple utility node to get both the first and last items of a list as separate outputs. This avoids the unnecessary sublist when using the List.Deconstruct node.
point = dtGeometry.Deconstruct.Point(point=ꟿ_list_firstlast.first)
code_block_2 = CodeBlock { 0; }
byCoordinates = Point.ByCoordinates(x=point.x, y=point.y, z=code_block_2)
point_2 = dtGeometry.Deconstruct.Point(point=ꟿ_list_firstlast.last)
code_block_3 = CodeBlock { 0; }
byCoordinates_2 = Point.ByCoordinates(x=point_2.x, y=point_2.y, z=code_block_3)
byStartPointEndPoint = Line.ByStartPointEndPoint(startPoint=byCoordinates, endPoint=byCoordinates_2)
code_block_4 = CodeBlock { 33271003; }
byID_2 = Custom[Element.ByID](IdOrUniqueId=code_block_4)
location_2 = Custom[Element.Location+](element=byID_2)
ꟿ_list_firstlast_2 = Custom[ꟿ List.FirstLast](list=location_2.curveEndpoints@L2)
point_3 = dtGeometry.Deconstruct.Point(point=ꟿ_list_firstlast_2.first)
code_block_5 = CodeBlock { 0; }
byCoordinates_3 = Point.ByCoordinates(x=point_3.x, y=point_3.y, z=code_block_5)
point_4 = dtGeometry.Deconstruct.Point(point=ꟿ_list_firstlast_2.last)
code_block_6 = CodeBlock { 0; }
byCoordinates_4 = Point.ByCoordinates(x=point_4.x, y=point_4.y, z=code_block_6)
byStartPointEndPoint_2 = Line.ByStartPointEndPoint(startPoint=byCoordinates_3, endPoint=byCoordinates_4)
doesIntersect = Geometry.DoesIntersect(geometry=byStartPointEndPoint, other=byStartPointEndPoint_2)
intersect = Geometry.Intersect(geometry=byStartPointEndPoint, other=byStartPointEndPoint_2)
curve = dtGeometry.Deconstruct.Curve(curve=intersect)
point_5 = dtGeometry.Deconstruct.Point(point=curve.startPt)
byCoordinates_5 = Point.ByCoordinates(x=point_5.x, y=point_5.y, z=point_3.z)
point_6 = dtGeometry.Deconstruct.Point(point=curve.endPt)
byCoordinates_6 = Point.ByCoordinates(x=point_6.x, y=point_6.y, z=point_3.z)
list_create = List.Create(item0=byCoordinates_5, item1=byCoordinates_6)
splitByPoints = Curve.SplitByPoints(curve=location_2.curves, points=list_create)
lastItem = List.LastItem(list=splitByPoints@L2)
setLocation = Element.SetLocation(element=byID_2)  # unwired: geometry
boundingBox = Element.BoundingBox(element=byID)
boundingBox_2 = Element.BoundingBox(element=byID_2)
intersection = BoundingBox.Intersection(boundingBox=boundingBox, other=boundingBox_2)
