# Dynamo graph WIP-SolveOverlapingLines2.dyn (Dynamo 2.3.2.15696)
# packages: archi-lab.net 2019.2.25, Clockwork for Dynamo 2.x 2.3.0, Chynamo 0.8.0

getWarnings = archilab.Revit.Elements.Warning.GetWarnings()
errorMessage = archilab.Revit.Elements.Warning.ErrorMessage(warning=getWarnings)
string = StringInput("A wall and a room separation line overlap. One of them may be ignored when Revit finds room boundaries. Shorten or delete the room separation line to remove the overlap.")
eq = errorMessage == string
filterByBoolMask = List.FilterByBoolMask(list=getWarnings, mask=eq)
elements = archilab.Revit.Elements.Warning.Elements(warning=filterByBoolMask.in)
id = archilab.Revit.Elements.WarningElement.Id(warningElement=elements)
byID = Custom[Element.ByID](IdOrUniqueId=id@L2)  # package Clockwork for Dynamo 2.x; Gets the Revit element(s) for a list of IDs (or a single ID). Optionally retrieves elements from linked documents as well.
name = Element.Name(element=byID)
firstItem = List.FirstItem(list=byID@L2)
lastItem = List.LastItem(list=byID@L2)
swap_items_in_list = Python(IN[0]=firstItem, IN[1]=lastItem)
# ---------- swap_items_in_list.python (24 lines) ----------
#SWAP ITEMS SO THAT THE FIRST LIST ALWAYS CONTAINS WALLS

# Load the Python Standard and DesignScript Libraries
import sys
import clr
clr.AddReference('ProtoGeometry')
from Autodesk.DesignScript.Geometry import *

# The inputs to this node will be stored as a list in the IN variables.
dataEnteringNode = IN

# Place your code below this line
walls = UnwrapElement(IN[0])
lines = UnwrapElement(IN[1])

for i in range(len(IN[0])):
	if walls[i].Name == "Model Lines":
		temp = walls[i]
		walls[i] = lines[i]
		lines[i] = temp

# Assign your output to the OUT variable.
OUT = [[a,b] for a,b in zip(walls,lines)]
#OUT = [IN[1][i] if IN[0][i] == "Model Lines" else IN[0][i] for i in range(len(IN[0]))]
# ----------------------------------------
firstItem_2 = List.FirstItem(list=swap_items_in_list@L2)
boundingBox = Element.BoundingBox(element=firstItem_2)
lastItem_2 = List.LastItem(list=swap_items_in_list@L2)
boundingBox_2 = Element.BoundingBox(element=lastItem_2)
python_script = Python(IN[0]=boundingBox, IN[1]=boundingBox_2)
# ---------- python_script.python (13 lines) ----------
# Load the Python Standard and DesignScript Libraries
import sys
import clr
clr.AddReference('ProtoGeometry')
from Autodesk.DesignScript.Geometry import *

# The inputs to this node will be stored as a list in the IN variables.
dataEnteringNode = IN

# Place your code below this line

# Assign your output to the OUT variable.
OUT = [[a,b] for a,b in zip(IN[0],IN[1])]
# ----------------------------------------
intersection = BoundingBox.Intersection(boundingBox=boundingBox, other=boundingBox_2)
minPoint = BoundingBox.MinPoint(boundingBox=intersection)
maxPoint = BoundingBox.MaxPoint(boundingBox=intersection)
list_create = List.Create(item0=minPoint, item1=maxPoint)
lastItem_3 = List.LastItem(list=list_create@L3)
flatten = List.Flatten(list=lastItem_3)
minPoint_2 = BoundingBox.MinPoint(boundingBox=boundingBox_2)
maxPoint_2 = BoundingBox.MaxPoint(boundingBox=boundingBox_2)
byStartPointEndPoint = Line.ByStartPointEndPoint(startPoint=minPoint_2, endPoint=maxPoint_2)
python_script_2 = Python(IN[0]=minPoint, IN[1]=maxPoint)  # same code as python_script
intersect = Geometry.Intersect(geometry=byStartPointEndPoint, other=python_script_2)
split = Geometry.Split(geometry=byStartPointEndPoint, other=intersect)
uniqueItems = List.UniqueItems(list=split@L2)
byStartPointEndPoint_2 = Line.ByStartPointEndPoint(startPoint=minPoint, endPoint=maxPoint)
intersect_2 = Geometry.Intersect(geometry=byStartPointEndPoint_2, lacing=Longest)  # unwired: other
flatten_2 = List.Flatten(list=intersect_2)
splitByIntersectionPoints = Custom[Curve.SplitByIntersectionPoints](curves=byStartPointEndPoint)  # package Chynamo; Break curves at their intersection points
getIntersectionPoint = Custom[Curve.GetIntersectionPoint](curve=python_script_2@@L1)  # package Chynamo; Get all intersection points of curves
delete = Element.Delete()  # unwired: element
setLocation = Element.SetLocation()  # unwired: element, geometry
