# Dynamo graph WIP_CADPointsToSurface.dyn (Dynamo 2.3.2.15696)
# packages: bimorphNodes 3.0.3

code_block = CodeBlock { "30827088"; }
count = List.Count()  # unwired: list
file_path = Filename("C:\Users\bekinci\REVIT_LOCAL\2020\AR_1712011_SIR_SIRIUS_bekinci_bvn.rvt")
reportInstances = CAD.ReportInstances(filePath=file_path)
lastItem = List.LastItem(list=reportInstances.report)
firstItem = List.FirstItem(list=lastItem)
code_block_2 = CodeBlock { "ST_SSL LTS Point Cloud 1m Grid"; }
pointsFromCADLayers = CAD.PointsFromCADLayers(importInstance=firstItem, layerNames=code_block_2)
flatten = List.Flatten(list=pointsFromCADLayers.Point)
byPoints = Topography.ByPoints()  # unwired: points
