# Dynamo graph WIP_DuplicateViewsToSheet.dyn (Dynamo 2.3.2.15696)
# packages: archi-lab.net 2019.2.25

duplicate_options = DuplicateOptionsUi("WithDetailing")
duplicate = archilab.Revit.Views.Views.Duplicate(options=duplicate_options)  # unwired: view, name
bv_place_view_on_sheet_at_point = Custom[bv Place View On Sheet at Point](ViewsList=duplicate)  # originally from SteamNodes; unwired: SheetList, PointsList
