# Dynamo graph WIP_RotateElevation.dyn (Dynamo 2.3.2.15696)
# packages: Genius Loci 2021.7.30, designtech 1.0.8

select_model_element = DSModelElementSelection()  # 1 picked in the model
element_locationcurve = Custom[Element LocationCurve](element=select_model_element)  # package Genius Loci; Gets the curve geometry from the element.
curve = dtGeometry.Deconstruct.Curve(curve=element_locationcurve)
XAxis = Vector.XAxis()
translate = Geometry.Translate(geometry=curve.startPt, direction=XAxis, distance=curve.len)
element_setlocation = Custom[Element SetLocation](element=select_model_element, location=translate)  # package Genius Loci; Modify the location of the given element. (Same as the Move command in Revit.) Works for point/ line/ sketch based elements, view-specific elements, groups and link instances.
point = dtGeometry.Deconstruct.Point(point=curve.startPt)
point_2 = dtGeometry.Deconstruct.Point(point=curve.endPt)
byCoordinates = Point.ByCoordinates(x=point.x, y=point_2.y, z=point_2.z)
byStartPointEndPoint = Line.ByStartPointEndPoint(startPoint=curve.startPt, endPoint=byCoordinates)
curve_2 = dtGeometry.Deconstruct.Curve(curve=byStartPointEndPoint)
angleWithVector = Vector.AngleWithVector(vector=curve.direction, otherVector=curve_2.direction)
element_setrotation = Custom[Element SetRotation](degree=angleWithVector)  # package Genius Loci; Set the angle of the element around its local Z-axis. (Same as the Rotate command in Revit); unwired: element
code_block = CodeBlock { 0.5; }
pointAtParameter = Curve.PointAtParameter(curve=element_locationcurve, param=code_block)
