# Dynamo graph WIP_TagStairByRoom.dyn (Dynamo 2.3.1.11775)
# packages: Clockwork for Dynamo 2.x 2.3.0, archi-lab.net 2019.2.25

views = Custom[Document.Views]()  # package Clockwork for Dynamo 2.x; Gets all views in the document - except for 3D view templates (as long as this bug is not fixed: https://github.com/DynamoDS/Dynamo/issues/2970)
code_block = CodeBlock { "View Template"; }
getParameterValueByName = Element.GetParameterValueByName(element=views, parameterName=code_block)
string_from_object = FromObject(obj=getParameterValueByName)

# group: INPUT
code_block_2 = CodeBlock { "30B_1 in 50 Concrete"; }

contains = String.Contains(str=string_from_object, searchFor=code_block_2)
filterByBoolMask = List.FilterByBoolMask(list=views, mask=contains)
isOnSheet = archilab.Revit.Views.Views.IsOnSheet(view=filterByBoolMask.in)
filterByBoolMask_2 = List.FilterByBoolMask(list=filterByBoolMask.in, mask=isOnSheet)
categories = Categories("OST_Stairs")
all_elements_of_category_in_view = ElementsOfCategoryInView(Category=categories, View=filterByBoolMask_2.in)
code_block_3 = CodeBlock { "Mark"; }
getParameterValueByName_2 = Element.GetParameterValueByName(element=all_elements_of_category_in_view, parameterName=code_block_3)
string_from_object_2 = FromObject(obj=getParameterValueByName_2)
code_block_4 = CodeBlock { "LOT"; }
contains_2 = String.Contains(str=string_from_object_2, searchFor=code_block_4)
filterByBoolMask_3 = List.FilterByBoolMask(list=all_elements_of_category_in_view, mask=contains_2)
boundingBox = Element.BoundingBox(element=filterByBoolMask_3.in)
properties = Custom[BoundingBox.Properties](boundingBox=boundingBox)  # package Clockwork for Dynamo 2.x; Retrieves the centroid, width, depth and height of a given bounding box
code_block_5 = CodeBlock { true; }
code_block_6 = CodeBlock { false; }
byElementAndLocation = Tag.ByElementAndLocation(view=filterByBoolMask_2.in, element=filterByBoolMask_3.in, location=properties.Centroid, horizontal=code_block_5, addLeader=code_block_6)
watch = Watch(properties.Centroid)
