# Dynamo graph callout_with_detailing.dyn (Dynamo 2.3.1.11775)
# packages: archi-lab.net 2019.2.25, Clockwork for Dynamo 2.x 2.3.0, designtech 1.0.8, Genius Loci 2021.7.30, Rhythm 2019.9.12, spring nodes 204.1.0

# group: INPUT (Filled Region)
select_filled_region = DSModelElementSelection()  # 1 picked in the model; graph input

ownerView = Custom[Element.OwnerView](element=select_filled_region)  # package Clockwork for Dynamo 2.x; Gets the owner view of a given Revit element (if possible)

# group: INPUT
select_view_family_type = ViewFamilyTypes("21C Demolition Series")  # graph input

boundingBox = Element.BoundingBox(element=select_filled_region)

# group: Create Callout by Filled Region Boundary
minPoint = BoundingBox.MinPoint(boundingBox=boundingBox)
maxPoint = BoundingBox.MaxPoint(boundingBox=boundingBox)
createCallout = dtRevit.View.CreateCallout(hostView=ownerView, calloutType=select_view_family_type, pt1=minPoint, pt2=maxPoint)

# group: INPUT
select_view_template = ViewTemplatesUi("21B-Demolition Callout")  # graph input

setViewTemplate = archilab.Revit.Views.Views.SetViewTemplate(view=createCallout, viewTemplate=select_view_template)

# group: INPUT
select_area_for_items_to_copy = DSModelElementsSelection()  # 24 picked in the model; graph input

id = Element.Id(element=select_area_for_items_to_copy)
string_from_object = FromObject(obj=id)
id_2 = Element.Id(element=select_filled_region)
string_from_object_2 = FromObject(obj=id_2)

# group: Filter from Selection
contains = String.Contains(str=string_from_object, searchFor=string_from_object_2)
filterByBoolMask = List.FilterByBoolMask(list=select_area_for_items_to_copy, mask=contains)
getCategory = Element.GetCategory(element=filterByBoolMask.out)
categories = Categories("OST_DetailComponents")
categories_2 = Categories("OST_Dimensions")
categories_3 = Categories("OST_Lines")
list_create = List.Create(item0=categories, item1=categories_2, item2=categories_3)
contains_2 = List.Contains(list=getCategory, item=list_create, lacing=CrossProduct)
identity = Object.Identity()  # unwired: obj
trueForAny = List.TrueForAny(predicate=identity)  # unwired: list
map = List.Map(list=contains_2, f_x=trueForAny)
filterByBoolMask_2 = List.FilterByBoolMask(list=filterByBoolMask.out, mask=map)

ꟿ_document_copyfromviewtoview = Custom[ꟿ Document.CopyFromViewToView](sourceView=ownerView, destView=setViewTemplate, elements=filterByBoolMask_2.in)  # package spring nodes; The node will copy the input (view based) elements from the source view into the destination view.
passthrough = Custom[Passthrough](passThrough=ownerView, waitFor=ꟿ_document_copyfromviewtoview)  # package Clockwork for Dynamo 2.x; Forces a sequential order of execution. The node wired into the output of the Passthrough node will be executed *after* the node wired into the waitFor input (e.g. important for some Revit operations). The value of the passThrough input will be passed on to the node wired into the output port of the Passthrough node.

# group: Set Callout to Parent View Sheet
code_block = CodeBlock { "Sheet Number"; }
parameterByName = Parameter.ParameterByName(element=passthrough, name=code_block)
string_from_object_3 = FromObject(obj=parameterByName)
code_block_2 = CodeBlock { [": "]; }
split = String.Split(str=string_from_object_3, separator0=code_block_2)
flatten = List.Flatten(list=split)
lastItem = List.LastItem(list=flatten)
string_from_object_4 = FromObject(obj=lastItem)
sheet_byname = Custom[Sheet ByName](NameOrNumber=string_from_object_4)  # package Genius Loci; Collects sheets by name or number in the active or given document.
code_block_3 = CodeBlock { 0; }
byCoordinates = Point.ByCoordinates(x=code_block_3, y=code_block_3, z=code_block_3)
ʳʰʸᵗʰᵐ_viewport_create = Rhythm.Revit.Elements.Viewport.Create(sheet=sheet_byname, view=setViewTemplate, location=byCoordinates)

passthrough_2 = Custom[Passthrough](passThrough=select_filled_region, waitFor=ʳʰʸᵗʰᵐ_viewport_create)
delete = Element.Delete(element=passthrough_2)
